# Grasshopper definition ACORN-shell.gh (Grasshopper 1.0.7)
# plug-ins: HAL for Grasshopper, AcornShell, karambaGH

sessionsettings = SessionSettings()
rectangle = Rectangle(Plane=PlaneXY(0, 0, 0), XSize="-3 to 3", YSize="-3 to 3", Radius=0)  # -> Rectangle, Length
rectangle_2 = Rectangle(Plane=PlaneXY(0, 0, 0), XSize="-3.9 to 3.9", YSize="-3.6 to 3.6", Radius=0)  # -> Rectangle, Length
a_makeshellplan = MakeShellPlan(Outline=rectangle_2.Rectangle, Corner_radius=Slider(0.2, range=0..1))  # -> Plan, Corners, Edges
a_formfindshell = FormFindShell(Plan_surface=a_makeshellplan.Plan, Corners=a_makeshellplan.Corners, Height=Slider(0.8, range=0..1), Run=Button())  # -> Form_found_surface, Kiwi_errors
srf = Surface(a_formfindshell.Form_found_surface)
mesh_breps = MeshBrepsKaramba3D(
    Brep=srf,
    MeshResolution=Slider(0.095, range=0..1),
    EdgeRefinementFactor=0.67,
    PointReduction=Toggle(False),
    SmoothingStepSize=Slider(1, range=0..1),
    SmoothingIterations=Slider(1, range=0..10))  # -> Mesh, Info
a_buildshellmodel = BuildShellModel(Mesh=mesh_breps.Mesh, Corners=a_makeshellplan.Corners, Thickness=Slider(0.06, range=0..0.1))
analyze = AnalyzeKaramba3D(Model=a_buildshellmodel)  # -> CalculatedModel, MaximumDisplacement_cm, ResultingForceOfGravity_kN, ElasticEnergy_kNm
a_shellstresslines = ShellStressLines(
    K3d_model=analyze.CalculatedModel,
    Surface=srf,
    Corners=a_makeshellplan.Corners,
    Edges=a_makeshellplan.Edges,
    Keystone_width=Slider(1.6, range=0..10),
    Cornerstone_width=Slider(1.5, range=0..10),
    Length_param_1=Slider(2, range=0..10),
    Length_param_2=Slider(2, range=0..10))  # -> Stress_lines_1, Stress_lines_2, Cable_profiles_1, Cable_profiles_2
a_segmentshell = SegmentShell(Surface=srf, Stress_lines_1=a_shellstresslines.Stress_lines_1, Stress_lines_2=a_shellstresslines.Stress_lines_2)
crv = Curve([a_shellstresslines.Cable_profiles_1, a_shellstresslines.Cable_profiles_2])
brep = Brep(a_segmentshell)
