# Grasshopper definition SHELLS_ACORN_master_2021.gh (Grasshopper 1.0.7)
# plug-ins: Capture, Sift, Kiwi3d, ACORNshells, Sampler, karambaGH

image = ImageSampler(Filter="Colour", Interpolate=False, Umax=1, Umin=0, Vmax=1, Vmin=0, Wrap=1)
thickness = Slider(0.061, range=0.02..0.12)
height = Slider(0.8, range=0..1)
number_slider = Slider(0.25, range=0..1)
polygon = Polygon(Plane=PlaneXY(0, 0, 0), Radius=3, Segments=Slider(5, range=3..6), FilletRadius=0)  # -> Polygon, Length

# ---- group: just because of squares
pi = Pi(Factor=".25")
rotate = Rotate(Geometry=polygon.Polygon, Angle=pi, Plane=PlaneXY(0, 0, 0))  # -> Geometry, Transform

# ----
pt = Point([Point(-2.65739868, 2.586695785, 0), Point(2.522828173, 2.363083722, 0), Point(4.069487342, -3.772482641, 0), Point(-1.375177545, -2.361354304, 0)])
pt_2 = Point([Point(0, 0, 0), Point(8, 0, 0), Point(6, 6, 0), Point(0, 6, 0)])
square_edge_length = Number(Slider(2, range=0..10))
pline = PolyLine(Vertices=pt_2, Closed=True)
rectangle = Rectangle(Plane=PlaneXY(0, 0, 0), XSize=Slider(7.8, range=0..10), YSize=Slider(7.2, range=0..10), Radius=0)  # -> Rectangle, Length
rectangle_2 = Rectangle(Plane=PlaneXY(0, 0, 0), XSize=square_edge_length, YSize=square_edge_length, Radius=0)  # -> Rectangle, Length
merge = Merge(Data1=Slider(5, range=5..10), Data2=height, Data3=thickness)
rectangle_3 = Curve(rectangle.Rectangle)
regular_polygon = Curve(rotate.Geometry)
square = Curve(rectangle_2.Rectangle)
irregular_quad = Curve(pline)
item = ListItem(List=merge, Index=0, Wrap=True)  # -> Item, Item1, Item2
thickness_m = Number(item.Item2)
span_m = Number("1")
height_m = Number(item.Item1)
filter = StreamFilter(Gate=Slider(0, range=0..10), Stream0=rectangle_3, Stream1=square, Stream2=regular_polygon, Stream3=irregular_quad)

# ---- group: center at 0,0,0
crv = Curve(filter)
area = Area(Geometry=crv)  # -> Area, Centroid
rev = Reverse(Vector=area.Centroid)
move = Move(Geometry=crv, Motion=rev)  # -> Geometry, Transform

# ----
bay_geometry = Geometry(move.Geometry)

# ---- group: Generate plan
number_slider_2 = Slider(0.2, range=0..1)
a_makeshellplan = MakeShellPlan(Outline=bay_geometry, CornerRadius=number_slider_2, CurvedCorner=Toggle(True))

# ----
number_slider_3 = Slider(36, range=0..100)
lor_7_8x7_2 = Surface(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)
_6x6 = Surface(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)
srf = Surface(a_makeshellplan)
shell = Surface(srf)  # disabled

# ----
# Kiwi Membrane
# fixed edges - DEBUGGING
shell_2 = Surface(shell)  # disabled
edges = BrepEdges(Brep=shell_2)  # -> Naked, Interior, NonManifold; disabled
len = Length(Curve=edges.Naked)  # disabled
height_m_2 = Number(height_m)  # disabled
lng = ListLength(List=edges.Naked)  # disabled
sort = SortList(Keys=len, ValuesA=edges.Naked)  # -> Keys, ValuesA; disabled
division = Division(A=lng, B=2)  # disabled
height_m_3 = Number(height_m_2)  # disabled
srf_2 = Surface(shell_2)  # disabled
split = SplitList(List=sort.ValuesA, Index=division)  # -> ListA, ListB; disabled
corners = Curve(split.ListA)  # disabled
edges_2 = Curve(split.ListB)  # disabled
corners_2 = Curve(corners)  # disabled
edges_3 = Curve(edges_2)  # disabled
brep = Brep(srf_2)  # disabled
corners_3 = Curve(corners_2)  # disabled
edges_4 = Curve(edges_3)  # disabled
panel = Panel("8")  # disabled
debrep = DeconstructBrep(Brep=brep)  # -> Faces, Edges, Vertices; disabled
pframes = PerpFrames(Curve=edges_4, Count=panel, Align=True)  # -> simplify(Frames), Parameters; disabled
list = ValueList({"STEEL": 1, "WOOD": 2, "GFRP": 3, "ETFE (Membrane)": 4, "CONCRETE": 5, "ALUMINIUM": 6}, selected="ETFE (Membrane)")  # disabled
panel_2 = Panel("0")  # disabled
cull_i = CullIndex(List=pframes.Frames, Indices=panel_2, Wrap=True)  # disabled
pt_3 = Point(debrep.Vertices)  # disabled
cull_i_2 = CullIndex(List=reverse(cull_i), Indices=panel_2, Wrap=True)  # -> simplify(List); disabled
matdef = MaterialDefaults(Type=list, IsNmm2=False, IskNcm2=False, IskNm2=True, mUnit=1)  # -> Material, YoungsModulus, AlphaT, Nue, Density, Strength; disabled
number_slider_4 = Slider(0.13, range=0..1)  # disabled
deplane = DeconstructPlane(Plane=cull_i_2)  # -> Origin, XAxis, YAxis, ZAxis; disabled
Y = UnitY(Factor=1)  # disabled
cable_prestress = Slider(0.1, range=0..0.5)  # disabled
load = Slider(0.095, range=0.005..0.095)  # disabled
X = UnitX(Factor=1)  # disabled
number_slider_5 = Slider(0.3, range=0..1)  # disabled
number_slider_6 = Slider(5, range=0..10)  # disabled
list_2 = ValueList({"STEEL": 1, "WOOD": 2, "GFRP": 3, "ETFE (Membrane)": 4, "CONCRETE": 5, "ALUMINIUM": 6}, selected="STEEL")  # disabled
dprod = DotProduct(VectorA=Y, VectorB=deplane.YAxis, Unitize=False)  # disabled
dprod_2 = DotProduct(VectorA=X, VectorB=deplane.YAxis, Unitize=False)  # disabled
multiplication = Multiplication(A=number_slider_4, B=height_m_3)  # disabled
list_3 = ValueList({"DEAD": 1, "SNOW": 2, "PRES": 3, "PRES_FL": 4}, selected="DEAD")  # disabled
panel_3 = Panel("FormFinding")  # disabled
list_4 = ValueList({"Displacements": 1, "Stresses": 2, "SupportForces": 3}, selected="Displacements")  # disabled
Z = UnitZ(Factor=1)  # disabled
toggle = BooleanToggle(False)  # disabled
load_2 = Number(load)  # disabled
panel_4 = Panel("8")  # disabled
prestress = Number(number_slider_5)  # disabled
srfref = SurfaceRefinement(PDeg=3, QDeg=3, IsKnotApproxElementSize=False, IsKnotSubdivision=True)  # disabled
abs = Absolute(Value=dprod)  # disabled
abs_2 = Absolute(Value=dprod_2)  # disabled
prestress_cable = Number(cable_prestress)  # disabled
matdef_2 = MaterialDefaults(Type=list_2, IsNmm2=False, IskNcm2=False, IskNm2=True, mUnit=1)  # -> Material, YoungsModulus, AlphaT, Nue, Density, Strength; disabled
crvref = CurveRefinement(PDeg=3, MinElementsU=panel_4, IsKnotApproxElementSize=False, IsKnotSubdivision=True)  # disabled
crv_2 = Curve(edges_4)  # disabled
supcrv = SupportCurve(Crv=corners_3, DispX=True, DispY=True, DispZ=True, Rot=False)  # disabled
suppt_constrain_edges = SupportPoint(Point=deplane.Origin, DispX=abs_2, DispY=abs, DispZ=toggle, Rotation=False, Torsion=False)  # disabled
srfload = SurfaceLoad(Brep=srf_2, Loadtype=list_3, Direction=Z, Value=load_2, LoadCase=1)  # disabled
membrane = MembraneElement(
    Brep=srf_2,
    Material=matdef.Material,
    Thickness=multiplication,
    Prestress1=prestress,
    Prestress2=prestress,
    Refinement=srfref,
    Formfinding=True,
    ShowPrestressDirections=False)  # disabled
fofi = Formfinding(Name=panel_3, FormfindingSteps=number_slider_6, Iterations=number_slider_6, OutputSetting=list_4)  # disabled
cable = CableElement(
    Curve=crv_2,
    Material=matdef_2.Material,
    Diameter=0.01,
    Prestress=prestress_cable,
    PrestressControl=False,
    CurveRefinement=crvref,
    Formfinding=True)  # disabled
path_mapper = PathMapper(suppt_constrain_edges, source="{A;B} (C)", target="{A;C} (B)")  # disabled
merge_2 = Merge(Data1=membrane, Data2=cable)  # -> flatten(Result); disabled
item_2 = ListItem(List=path_mapper, Index=0, Wrap=True)  # disabled
merge_3 = Merge(Data1=item_2, Data2=supcrv)  # -> flatten(Result); disabled
panel_5 = Panel("C:\Users\ec977\OneDrive - University of Bath\Eduardo\_DEVELOPMENT\__ PINBED SHELL\kiwiDump")  # disabled
button = Button()  # disabled
amodel = AnalysisModel(
    Analysis=fofi,
    StructuralElements=merge_2,
    Supports=merge_3,
    Loads=srfload,
    IntersectionTolerance=0.001,
    IsCarat=True,
    IsKratos=False,
    PenaltyFac=10000000,
    ShowCouplingIDs=False,
    ShowEdgeIDs=False,
    ShowGeo=True,
    ShowPatchIDs=True,
    ShowPrePro=True,
    ShowRef=False)  # disabled
run_analysis = IGASolver(AnalysisModel=amodel, Path=panel_5, Run=button, antiFreeze=False, showWindow=True)  # -> ResultModel, ErrorReport; disabled

# ---- group: Scale deformed shell to target height
defmod = DeformedModel(Model=run_analysis.ResultModel, ScaleFactor=1, FlyingNodeLimit=100000)  # -> Model, Geo, DeformedStructuralElements; disabled
item_3 = ListItem(List=defmod.Geo, Index=0, Wrap=True)  # disabled
shell_3 = Surface(item_3)  # disabled
bbox = BoundingBox(Content=shell_3, Plane=PlaneXY(0, 0, 0))  # -> Box, Box_2; disabled
boxsize = BoxSize(box=bbox.Box)  # -> X_2, Y_2, Z_2, A_2, V_2; disabled
height_m_4 = Number(height_m_3)  # disabled
panel_6 = Panel(boxsize.Z_2)  # disabled
division_2 = Division(A=height_m_4, B=boxsize.Z_2)  # disabled
defmod_2 = DeformedModel(Model=defmod.Model, ScaleFactor=division_2, FlyingNodeLimit=100000)  # -> Model, Geo, DeformedStructuralElements; disabled
panel_7 = Panel(division_2)  # disabled
item_4 = ListItem(List=defmod_2.Geo, Index=0, Wrap=True)  # disabled
shell_4 = Surface(item_4)  # disabled

# ----
multipatch_gh = MultiPatchGH(bay_geometry=bay_geometry, shell_plan=srf)  # disabled
neg = Negative(Value=Slider(2, range=0..10))
number_slider_7 = Slider(6, range=1..12)  # disabled
_10º = PowerOf10(Value=neg)
multiplication_2 = Multiplication(A=Slider(1.5, range=1..10), B=_10º)
tested_anna_bauer = Panel("0.013")
panel_8 = Panel(multiplication_2)
load_3 = Number(multiplication_2)
membrane_prestress_u = Slider(0.15, range=0..0.5)
membrane_prestress_v = Slider(0.15, range=0..0.5)
cable_prestress_2 = Slider(0.15, range=0..0.5)
load_4 = Slider(0.015, range=0.005..0.095)
panel_9 = Panel("0.15")
panel_10 = Panel("0.084")
prestress_v = Number(membrane_prestress_v)
prestress_u = Number(membrane_prestress_u)
prestress_cable_2 = Number(cable_prestress_2)
load_5 = Number(load_4)

# ---- group: Form finding - Mish's values
supportcurve = BooleanToggle(False)
scaledeform = BooleanToggle(False)
height_m_5 = Number(height_m)
a_formfindkiwi = FormFindKiwi(
    PlanShell=srf,
    Height=height_m_5,
    SubDiv=Slider(30, range=0..100),
    Run=Button(),
    CurveSupports=supportcurve,
    ScaleDeform=scaledeform,
    ThicknessFactor=Slider(0.1, range=0..1))  # -> KiwiErrors, FormFoundShell; disabled

# ----
scaledeform_2 = BooleanToggle(True)

# ---- group: Form finding - LoR values
supportcurve_2 = BooleanToggle(True)
height_m_6 = Number(height_m)
a_formfindkiwi_2 = FormFindKiwi(
    PlanShell=srf,
    Height=height_m_6,
    SubDiv=Slider(10, range=0..100),
    Run=Button(),
    CurveSupports=supportcurve_2,
    ScaleDeform=scaledeform_2,
    ThicknessFactor=Slider(0.125, range=0..0.2))  # -> KiwiErrors, FormFoundShell

# ---- group: Formfinding - membrane
supportcurve_3 = BooleanToggle(True)
scaledeform_3 = BooleanToggle(True)
height_m_7 = Number(height_m)
a_formfindmembrane = FormFindMembrane(
    PlanShell=srf,
    MultiplePatches=multipatch_gh,
    Height=height_m_7,
    SubDiv=Slider(10, range=0..100),
    Run=Button(),
    CurveSupports=supportcurve_3,
    ScaleDeform=scaledeform_3,
    ThicknessFactor=Slider(0.13, range=0..1),
    MembranePrestressU=prestress_u,
    MembranePrestressV=prestress_v,
    CablePrestressV=prestress_cable_2,
    Load=load_5,
    PlanarEdges=Toggle(True),
    UpdateOnChange=Toggle(True))  # -> KiwiErrors, FormFoundShell

# ----
list_5 = ValueList({"Random": 0, "Grid": 1, "Latin hypercube": 2}, selected="Grid")
geo = Geometry()
sampler = Sampler(Variables=[cable_prestress_2, load_4], Samples=Slider(10, range=0..10), Type=list_5, Seed="0", Directory="None")  # -> DesignMap, Data
geo_2 = Geometry(a_formfindmembrane.FormFoundShell)
geo_cable_prestress_01 = Geometry(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)
geo_cable_prestress_5 = Geometry(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)
geo_cable_prestress_05 = Geometry(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)
geo_cable_prestress_1 = Geometry(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)
geo_cable_prestress_2 = Geometry(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)
panel_11 = Panel(sampler.DesignMap)
# cable prestress 0.1
# load 0.015
_1st_ff_membrane = Data(Tree({0}: [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], {1}: [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], {2}: [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]))
# cable prestress 1.70
# load 0.015
_2nd_ff_membrane = Data(Tree({0}: [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], {1}: [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], {2}: [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]))
ff_replicated_lor = Data(Tree({0}: [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], {1}: [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], {2}: [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]))
lor_7_8x7_2_2 = Surface(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)
merge_4 = Merge(
    Data1=geo_cable_prestress_5,
    Data2=geo_cable_prestress_2,
    Data3=geo_cable_prestress_1,
    Data4=geo_cable_prestress_05,
    Data5=geo_cable_prestress_01)
lng_2 = ListLength(List=merge_4)
series = Series(Start=0, Step=Slider(3, range=0..10), Count=lng_2)
vec = VectorXYZ(XComponent=series, YComponent=series, ZComponent=0)  # -> Vector, Length
sift = Sift(Variables=[cable_prestress_2, load_4], DesignMap=sampler.DesignMap, Index=Slider(9, range=0..10))  # disabled
move_2 = Move(Geometry=merge_4, Motion=vec.Vector)  # -> Geometry, Transform
panel_12 = Panel(sift)

# ----
# .15 membrane and cable prestress
# .015 load
ff_membrane = Data(Tree({0}: [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], {1}: [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], {2}: [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]))

shell_5 = Brep(geo_2)

# ---- group: Preliminary analysis
mesh_breps = MeshBrepsKaramba3D(
    Brep=shell_5,
    MeshResolution=Slider(0.1, range=0..1),
    EdgeRefinementFactor=0.67,
    PointReduction=Toggle(False),
    SmoothingStepSize=Slider(1, range=0..1),
    SmoothingIterations=Slider(1, range=0..10))  # -> Mesh, Info
thickness_m_2 = Number(thickness_m)
a_preliminaryshellanalysismodel = PreliminaryShellAnalysisModel(ShellSurface=shell_5, Mesh=mesh_breps.Mesh, Thickness=thickness_m_2)
analyze = AnalyzeKaramba3D(Model=a_preliminaryshellanalysismodel)  # -> CalculatedModel, MaximumDisplacement_cm, ResultingForceOfGravity_kN, ElasticEnergy_kNm

# ----
shell_6 = Brep(shell_5)

# ---- group: Segment shell
a_stresslines = StressLines(
    Model=analyze.CalculatedModel,
    Shell=shell_5,
    KeystoneWidth=Slider(2, range=0..2),
    CornerstoneWidth=Slider(2, range=0..2),
    LengthParam1=Slider(2.7, range=0..3),
    LengthParam2=Slider(1.5, range=0..3))  # -> StressLines1, StressLines2, CableProfiles1, CableProfiles2
a_segment = Segment(Shell=shell_5, StressLines1=a_stresslines.StressLines1, StressLines2=a_stresslines.StressLines2)

# ----
# Analyse whole shell
number_slider_8 = Slider(0.2, range=0..1)
thickness_m_3 = Number(thickness_m)
srf_3 = Surface(shell_6)
thickness_m_4 = Number(thickness_m_3)
mesh_breps_2 = MeshBrepsKaramba3D(
    Brep=srf_3,
    MeshResolution=Slider(0.1, range=0..1),
    EdgeRefinementFactor=number_slider_8,
    PointReduction=False,
    SmoothingStepSize=Slider(1, range=0..1),
    SmoothingIterations=Slider(3, range=0..10))  # -> Mesh, Info
load_pattern = Slider(2, range=1..7)
mesh = Mesh(mesh_breps_2.Mesh)
image_2 = ImageSampler(Filter="Colour", Interpolate=False, Umax=1, Umin=0, Vmax=1, Vmin=0, Wrap=1)
dead_load_kn_m2 = Slider(1, range=0..10)
live_load_kn_m2 = Slider(1.5, range=0..10)
load_pattern_2 = Integer(load_pattern)
matselect = MaterialSelectionKaramba3D(menu=[dropdown(3), dropdown(9)])
fixes_supp = BooleanToggle(False)
a_shellloads = ShellLoads(Mesh=mesh, DeadLoadValue=dead_load_kn_m2, LiveLoadValue=live_load_kn_m2, LiveLoadPattern=load_pattern_2)  # -> Loads, CheckPoints
thickness_m_5 = Number(thickness_m_4)
a_preliminaryshellanalysismodel_2 = PreliminaryShellAnalysisModel(
    ShellSurface=srf_3,
    Mesh=mesh,
    Thickness=thickness_m_5,
    Material=matselect,
    Loads=a_shellloads.Loads,
    FixedSupport=fixes_supp)
model = ModelKaramba3D(a_preliminaryshellanalysismodel_2)
a_results = AnalysisResults(KarambaModel=model, Percentile=Slider(99, range=90..100), FirstPrincipalStressOnly=Toggle(False))  # -> MaxComp, MaxComp_2, MaxCompMesh, MaxTens, MaxTens_2, MaxTensMesh, MaximumDisplacement, BucklingFactor, AnalysedModelThI, AnalysedModelThII
modelview = ModelViewKaramba3D(Model=a_results.AnalysedModelThI, ResultFactors=1, ResultCase=-1)  # -> Model, DeformedMesh, DeformedAxes, DeformedModel
merge_5 = Merge(
    Data1=a_results.MaxComp,
    Data2=a_results.MaxComp_2,
    Data3=a_results.MaxTens,
    Data4=a_results.MaxTens_2,
    Data5=a_results.BucklingFactor,
    Data6=a_results.MaximumDisplacement)
mesh_2 = Mesh(a_results.MaxCompMesh)
mesh_3 = Mesh(a_results.MaxTensMesh)
shellview = ShellViewKaramba3D(Model=modelview.Model, IndexOfLayer=0)  # -> Model, MeshesOfRenderedShells, LegendColors, LegendTags
medges = MeshEdges(Mesh=shellview.MeshesOfRenderedShells)  # -> NakedEdges, InteriorEdges, NonManifoldEdges
panel_13 = Panel(merge_5)
merge_6 = Merge(Data1=medges.NakedEdges, Data2=shellview.MeshesOfRenderedShells)
legend = Legend(Colour=shellview.LegendColors, Tags=shellview.LegendTags, LegendType=1)
crv_3 = Curve(medges.NakedEdges)
geo_vizshell = Geometry(merge_6)

entwine = Entwine(Branch00=a_stresslines.CableProfiles2, Branch01=a_stresslines.CableProfiles1, FlattenInputs=True)  # -> simplify(Result)
static_segmentations = StaticSegmentations()

# ----
# TODO:
# adapt to actual segments (not flat)
list_6 = ValueList({"Split to edge": 0, "Split to corner": 1}, selected="Split to edge")
project = Project(Geometry=a_segment, Plane=PlaneXY(0, 0, 0))  # -> Geometry, Transform
segment_subdivision_wip = SegmentSubdivisionWIP(shell=shell_5, model=analyze.CalculatedModel, proj_segments=project.Geometry, split_direction=list_6)  # disabled

# ----
# local optimisation of
# segment geometry
# as alternative to segment component
# 
# should in addition or be integrated
max_r = Slider(0.26, range=0..1)
genes_for_r = GenePool(
    Decimals=3,
    Maximum=1,
    Minimum=0,
    Value=[0.728, 0.278, 0.433, 0.626, 0.372, 0.386, 0.577, 0.602, 0.355, 0.402, 0.734, 0.343, 0.433, 0.4, 0.584, 0.602, 0.546, 0.339, 0.419, 0.149, 0.301, 0.008, 0.324, 0.386])
local_optimization = BooleanToggle(False)
genes_for_phi = GenePool(
    Decimals=3,
    Maximum=2,
    Minimum=0,
    Value=[0.427, 1.627, 0.784, 0.976, 1.468, 0.46, 1.011, 0.388, 0.825, 1.223, 1.146, 1.007, 0.773, 1.539, 1.505, 0.869, 0.424, 1.086, 1.514, 0.679, 1.331, 1.248, 1.135, 0.331])
entwine_2 = Entwine(Branch00=a_stresslines.StressLines1, Branch01=a_stresslines.StressLines2, FlattenInputs=True)  # disabled
get_projected_segments = GetProjectedSegments(
    shell=shell_5,
    stress_lines=entwine_2,
    maximum_deviation=max_r,
    local_optimization=local_optimization,
    phi_values=genes_for_phi,
    rho_values=genes_for_r)

# ---- group: 2nd chance to Kiwi analysis results...
shell_7 = Brep(shell_6)  # disabled
number_slider_9 = Slider(0.5, range=0..1)  # disabled
number_slider_10 = Slider(5, range=0..10)  # disabled
list_7 = ValueList({"STEEL": 1, "WOOD": 2, "GFRP": 3, "ETFE (Membrane)": 4, "CONCRETE": 5, "ALUMINIUM": 6}, selected="CONCRETE")  # disabled
panel_14 = Panel("0")  # disabled
panel_15 = Panel("1")  # disabled
list_8 = ValueList({"Displacements": 1, "Stresses": 2, "SupportForces": 3}, selected=["Displacements", "Stresses", "SupportForces"])  # disabled
dom²num = ConstructDomain²(UMin=panel_14, UMax=panel_15, VMin=panel_14, VMax=number_slider_9)  # disabled
shell_8 = Brep(shell_7)  # disabled
matdef_3 = MaterialDefaults(Type=list_7, IsNmm2=False, IskNcm2=False, IskNm2=True, mUnit=1)  # -> Material, YoungsModulus, AlphaT, Nue, Density, Strength; disabled
srfref_2 = SurfaceRefinement(
    PDeg=3,
    QDeg=3,
    ElementRefU=number_slider_10,
    ElementRefV=number_slider_10,
    IsKnotApproxElementSize=False,
    IsKnotSubdivision=True)  # disabled
subsrf = Isotrim(Surface=reparameterize(shell_8), Domain=dom²num)  # disabled
number_slider_11 = Slider(10, range=0..10)  # disabled
edges_5 = BrepEdges(Brep=shell_7)  # -> Naked, Interior, NonManifold; disabled
list_9 = ValueList({"DEAD": 1, "SNOW": 2, "PRES": 3, "PRES_FL": 4}, selected="DEAD")  # disabled
culln = CullNth(List=edges_5.Naked, CullFrequency=2)  # disabled
visopt = VisualizeOptions(
    ScaleCrossSections=1,
    ScaleSupports=1,
    ScaleLoads=1,
    ScaleCouplingPoints=1,
    ScaleConnectingPoints=1,
    ScaleRefinedControlPoints=1,
    ColourBeam=RGB(211, 211, 211),
    ColourCable=RGB(255, 255, 255),
    ColourSupports=RGB(232, 65, 119),
    ColourLoads=RGB(232, 65, 119),
    ColourConnects=RGB(255, 255, 255),
    ColourRefinedPatches=RGB(139, 0, 0),
    ColourSliding=RGB(135, 16, 55))  # disabled
supcrv_2 = SupportCurve(Crv=culln, DispX=True, DispY=True, DispZ=True, Rot=False)  # disabled
shell_9 = ShellElement(Brep=shell_7, Material=matdef_3.Material, Thickness=0.1, Refinement=srfref_2, HingeCoupling=False)  # disabled
srfload_2 = SurfaceLoad(Brep=shell_8, Loadtype=list_9, Direction=Vector(0, 0, -1), Value=number_slider_11, LoadCase=1)  # disabled
lina = LinearAnalysis(Name="MyAnalysis", OutputSetting=list_8)  # disabled
button_2 = Button()  # disabled
amodel_2 = AnalysisModel(
    Analysis=lina,
    StructuralElements=shell_9,
    Supports=supcrv_2,
    Loads=srfload_2,
    Visualizer=visopt,
    IntersectionTolerance=0.001,
    IsCarat=True,
    IsKratos=False,
    PenaltyFac=10000000,
    ShowCouplingIDs=False,
    ShowEdgeIDs=False,
    ShowGeo=True,
    ShowPatchIDs=True,
    ShowPrePro=True,
    ShowRef=False)  # disabled
list_10 = ValueList({"X Displacement": 1, "Y Displacement": 2, "Z Displacement": 3, "Displacement Length": 4, "P_N1": 5, "P_N2": 6, "N1": 7, "N2": 8, "N12": 9, "P_M1 (Shell)": 10, "P_M2 (Shell)": 11, "M1 (Shell)": 12, "M2 (Shell)": 13, "M12 (Shell)": 14, "von_Mises (Shell)": 15}, selected="P_M1 (Shell)")  # disabled
list_11 = ValueList({"X Displacement": 1, "Y Displacement": 2, "Z Displacement": 3, "Displacement Length": 4, "P_N1": 5, "P_N2": 6, "N1": 7, "N2": 8, "N12": 9, "P_M1 (Shell)": 10, "P_M2 (Shell)": 11, "M1 (Shell)": 12, "M2 (Shell)": 13, "M12 (Shell)": 14, "von_Mises (Shell)": 15}, selected="P_M2 (Shell)")  # disabled
number_slider_12 = Slider(0.1, range=0..0.1)  # disabled
list_12 = ValueList({"X Displacement": 1, "Y Displacement": 2, "Z Displacement": 3, "Displacement Length": 4, "P_N1": 5, "P_N2": 6, "N1": 7, "N2": 8, "N12": 9, "P_M1 (Shell)": 10, "P_M2 (Shell)": 11, "M1 (Shell)": 12, "M2 (Shell)": 13, "M12 (Shell)": 14, "von_Mises (Shell)": 15}, selected="P_M2 (Shell)")  # disabled
analysis_completed = IGASolver(AnalysisModel=amodel_2, Run=button_2, antiFreeze=False, showWindow=True)  # -> ResultModel, ErrorReport; disabled
_2dresults = _2DElementResults(Model=analysis_completed.ResultModel, Type=list_10, Scaling=number_slider_12)  # -> IDGP, V, R, LocationGP, ParameterLocationGP; disabled
_2dresults_2 = _2DElementResults(Model=analysis_completed.ResultModel, Type=list_11, Scaling=number_slider_12)  # -> IDGP, V, R, LocationGP, ParameterLocationGP; disabled
_2drescolplot = _2DElementResultColourPlot(Model=analysis_completed.ResultModel, Type=list_12, VisMeshCoarse=True, VisMeshSmooth=False)  # -> Model, Mesh, ValueDomain, LegendC, LegendT; disabled
_2dresiso = _2DElementResultIsolines(Model=analysis_completed.ResultModel, Type=list_12, ShowLevelNumbers=False)  # -> Isolines, Levels, LegendC, LegendT; disabled
lng_3 = ListLength(List=_2dresults.V)  # disabled
number_slider_13 = Slider(1000, range=0..1000)  # disabled
subtraction = Subtraction(A=lng_3, B=1)  # disabled
legend_2 = Legend(Colour=_2drescolplot.LegendC, Tags=_2drescolplot.LegendT, LegendType=1)  # disabled
legend_3 = Legend(Colour=_2dresiso.LegendC, Tags=_2dresiso.LegendT, LegendType=1)  # disabled
geo_3 = Geometry(_2dresiso.Isolines)  # disabled
dom = ConstructDomain(DomainStart=0, DomainEnd=subtraction)  # disabled
random = Random(Range=dom, Number=number_slider_13, Seed=2)  # disabled
item_5 = ListItem(List=_2dresults.R, Index=random, Wrap=True)  # disabled
item_6 = ListItem(List=_2dresults_2.R, Index=random, Wrap=True)  # disabled

# ---- group: # segments
geo_4 = Geometry(get_projected_segments)
lng_4 = ListLength(List=geo_4)
bbox_2 = BoundingBox(Content=geo_4, Plane=PlaneXY(0, 0, 0), UnionBox=True)  # -> Box, Box_2
volume = Volume(Geometry=bbox_2.Box)  # -> Volume, Centroid
tag = TextTag(Location=volume.Centroid, Text=lng_4)

# ----
disassemble = DisassembleMaterialKaramba3D(Material=matselect)  # -> Material, TypeOfMaterial, FamilyNameOfMaterial, NameOfMaterial, ElemIdentifiers, Color, YoungsModulusKNCm2Dir12, InPlaneShearModulus_kN_cm2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
panel_16 = Panel(disassemble.YieldStrengthKNCm2Dir12)

# ---- group: illustration IASS2021
srf_4 = Surface(srf_3)  # disabled
number_slider_14 = Slider(1, range=0..10)  # disabled
project_2 = Project(Geometry=srf_4, Plane=PlaneXY(0, 0, 0))  # -> Geometry, Transform; disabled
number_slider_15 = Slider(4, range=0..10)  # disabled
modelview_2 = ModelViewKaramba3D(Model=a_results.AnalysedModelThI, ResultFactors=1, ResultCase=-1)  # -> Model, DeformedMesh, DeformedAxes, DeformedModel; disabled
Z_2 = UnitZ(Factor=number_slider_14)  # disabled
shellview_2 = ShellViewKaramba3D(Model=modelview_2.Model, IndexOfLayer=0)  # -> Model, MeshesOfRenderedShells, LegendColors, LegendTags; disabled
one_over_x = OneOverX(Value=number_slider_15)  # disabled
rev_2 = Reverse(Vector=Z_2)  # disabled
plan = Geometry(project_2.Geometry)  # disabled
sqgrid = Square(Plane=PlaneXY(0, 0, 0), Size=one_over_x, ExtentX=number_slider_15, ExtentY=number_slider_15)  # -> Cells, Points; disabled
move_3 = Move(Geometry=srf_4, Motion=rev_2)  # -> Geometry, Transform; disabled
move_4 = Move(Geometry=plan, Motion=rev_2)  # -> Geometry, Transform; disabled
geo_5 = Geometry(shellview_2.MeshesOfRenderedShells)  # disabled
surf = Geometry(move_3.Geometry)  # disabled
swatch = ColourSwatch(SwatchColor=RGB(255, 255, 255))  # disabled
medges_2 = MeshEdges(Mesh=geo_5)  # -> NakedEdges, InteriorEdges, NonManifoldEdges; disabled
join = JoinCurves(Curves=medges_2.NakedEdges, Preserve=False)  # disabled
preview = CustomPreview(Geometry=medges_2.InteriorEdges, Material=swatch)  # disabled
iso = IsoCurve(Surface=reparameterize(surf), UVPoint=sqgrid.Points)  # -> UIsocurve, VIsocurve; disabled

# ----
panel_17 = Panel("C:\Users\ec977\OneDrive - University of Bath\Eduardo\_DEVELOPMENT\__ PINBED SHELL\DSEdump\")
concat = Concatenate(FragmentA=panel_17, FragmentB="png\")
concat_2 = Concatenate(FragmentA=panel_17, FragmentB="csv\")
list_13 = ValueList({"eval": 0, "screenshots": 1, "both": 2, "neither": 3}, selected="both")
data = Data([-12.57171955, -0.8235394202, 16.82224841, 2.148346466, 12.19641905, 0.3854592119])
panel_18 = Panel(concat_2)

# ----
# PINBED
# SIMULATION
# merge FitBBox and FitMods?
# Slow due to surface split
number_slider_16 = Slider(2, range=0..10)
segments = Surface(simplify(graft(a_segment)))  # disabled
number_slider_17 = Slider(1, range=0..1)
a_fitbbox = FitBoundingBox(Segment=segments, AngularResolution=number_slider_16, Rotate3D=Toggle(False))
a_fitmods = FitPinbedModules(Box=flatten(a_fitbbox), Width=number_slider_17, Depth=number_slider_17, ToleranceLevel=Slider(3, range=0..10))  # -> simplify(ModuleRectangles)
a_areaeff = GetAreaEfficiency(Segment=segments, Modules=a_fitmods)
avr = Average(Input=flatten(a_areaeff))
a_simpinbed = SimulatePinbed(
    ShellSegments=segments,
    Modules=a_fitmods,
    VH=Toggle(False),
    SelectedSegments=Slider(4, range=0..10),
    MaximumPinLength=Slider(0.4, range=0..1))  # -> ShellSegments, ExtendedSegments, Modules, Boxes, PinAxes, PinHeights, PinColors
geo_6 = Geometry(a_simpinbed.Boxes)
geo_7 = Geometry(a_simpinbed.Modules)
geo_8 = Geometry(a_simpinbed.ExtendedSegments)
preview_2 = CustomPreview(Geometry=a_simpinbed.PinAxes, Material=a_simpinbed.PinColors)
end = EndPoints(Curve=a_simpinbed.PinAxes)  # -> Start, End
lng_5 = ListLength(List=end.Start)
series_2 = Series(Start=0, Step=1, Count=lng_5)
tag_2 = TextTag(Location=end.Start, Text=series_2)

panel_19 = Panel(data)

# ----
# Things that Capture
# does not capture
shell_10 = Brep(shell_6)
rec = DataRecorder(shell_10, DataLimit=-10, RecordData=True)

capture = Capture(
    Variables=[cable_prestress_2, load_4],
    Objectives=merge_5,
    Mode=list_13,
    Properties=0,
    DesignMap=sampler.DesignMap,
    CsvFilename="all-data",
    CsvDirectory=concat_2,
    ScreenshotFilename="design",
    ScreenshotDirectory=concat,
    BackupFrequency=0)  # -> DesignMapObjectives, CapturedProperties, Data, Images, Index
panel_20 = Panel(capture.Index)
cull_i_3 = CullIndex(List=rec, Indices="-1", Wrap=True)
geo_9 = Geometry(a_simpinbed.ShellSegments)
item_7 = ListItem(List=cull_i_3, Index=Slider(10, range=0..10), Wrap=True)
mish_original = Data([-19.30257598, -0.7425017873, 2.177992639, 34.107802, 11.14650472, 0.4905725352])
lor = Data([-12.46532366, -0.8249953181, 2.070751925, 15.54490841, 11.78721557, 0.3967481822])
galapagos = Galapagos(fitness=avr, gene=[genes_for_r, genes_for_phi])
panel_21 = Panel(mish_original)
panel_22 = Panel(lor)
number_slider_18 = Slider(3, range=0..10)
toggle_2 = BooleanToggle(True)
_2d_dm_os = Data(Tree({0}: ["0.0625", "0.01625", "-39.1895848858059", "-8.9993241426289", "5.57032285941102", "10.4200582918601", "20.5407104853313", "0.770185030859613"], {1}: ["0.0625", "0.03875", "-47.3462833525094", "-11.5622345758172", "8.00031503304406", "17.2965119889639", "12.5387541608633", "1.71960186748331"], {2}: ["0.0625", "0.06125", "-48.7191493061379", "-12.7116294908595", "8.85955148590197", "13.2741954189433", "15.2619584648131", "2.14762773539474"], {3}: ["0.0625", "0.08375", "-48.2580577010341", "-12.5879415130719", "8.68936202907467", "13.0461989920814", "15.8380923779244", "2.10526752648688"], {4}: ["0.1875", "0.01625", "-29.0105441117203", "-9.22169670719454", "4.12673962777161", "18.0050244684205", "18.3643724470186", "0.516664635381798"], {5}: ["0.1875", "0.03875", "-27.9879191503413", "-9.3389686217593", "4.87670077032855", "20.1698036781615", "20.6120180880821", "0.528058029154183"]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))
_2d_shells = Data([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])
panel_23 = Panel(_2d_dm_os)
item_8 = ListItem(List=_2d_shells, Index=Slider(0, range=0..15), Wrap=True)
_1d_dm_os = Data(Tree({0}: ["0.025", "-37.874947627171", "-8.95764969622038", "5.40409522016851", "13.4410429765333", "19.4909934084296", "0.85299915897477"], {1}: ["0.075", "-31.7265622604604", "-8.81784722328194", "5.05665637546799", "11.29582461888", "20.8998166428587", "0.668615839828643"], {2}: ["0.125", "-26.2198126848557", "-8.73313716268411", "4.68602408297715", "11.014144009581", "20.3599251414822", "0.563699802562929"], {3}: ["0.175", "-27.088900105798", "-8.66074800855203", "4.35185365971822", "14.7913920847151", "19.2740114218428", "0.558728100551588"], {4}: ["0.225", "-29.4307456158876", "-8.72190791634638", "4.03710250884073", "20.7085806026499", "17.9347190459721", "0.546537989016604"], {5}: ["0.275", "-31.064389530563", "-8.86852735330283", "3.73227100659508", "24.6521696544955", "16.5883530462279", "0.529226112973312"], {6}: ["0.325", "-34.403383265062", "-9.02385382142658", "3.47732419955679", "29.8092390880678", "15.3632702012331", "0.513531154730639"], {7}: ["0.375", "-40.9877288068801", "-9.30126347650348", "3.28756904197686", "34.8438324461057", "14.2870853895216", "0.497755173077441"], {8}: ["0.425", "-46.3225100709744", "-9.56660846675569", "3.12489018636109", "37.4492895962425", "13.399258772426", "0.484371186044961"], {9}: ["0.475", "-63.1864636736706", "-9.78106470944425", "3.01819930949885", "41.9215472107146", "12.6960549849116", "0.468357907953177"]))
_1d_shells = Data([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])
number_slider_19 = Slider(1, range=0..1)
panel_24 = Panel(_1d_dm_os)
split_2 = SplitList(List=_2d_dm_os, Index=Slider(2, range=0..10))  # -> simplify(ListA), simplify(ListB)
# dimensions: shell #
# loading pattern
# thickness [mm]
panel_25 = Panel("""Cable prestress
Load""")
panel_26 = Panel("""maximum compression stress [MPa]
top 99% compression stress [MPa]
top 99% tension stress [MPa]
maximum tension stress [MPa]
buckling safety factors
maximum deflection 2nd order [cm] """)
cable_prestress_3 = Slider(0.232, range=0..0.5)
result = Slider(0, range=0..5)
panel_27 = Panel(split_2.ListB)
panel_28 = Panel(split_2.ListA)
load_6 = Slider(0.005, range=0.005..0.095)
panel_29 = Panel("""20.000
20.000
20.000
20.000
10
10""")
parameter = Slider(1, range=0..2)
merge_7 = Merge(Data1=cable_prestress_3, Data2=load_6)
pt_4 = ConstructPoint(XCoordinate="-10", YCoordinate="-40", ZCoordinate=0)
make_2d_graph = Make2DGraph(
    graph_origin=pt_4,
    selected_result_y_axis=result,
    selected_parameter_x_axis=parameter,
    result_labels=panel_26,
    reference_values=panel_29,
    parameter_labels=panel_25,
    design_space_vectors=panel_28,
    all_results=panel_27,
    current_solution=merge_7)

# ---- group: ACORN sampler
# difference from DSE:
# DSE subdivides slider domain into N subdomain and samples mid point;
# ACORN includes end points of sliders, subdivides into N-1 subdomains and samples all start points plus last endpoint
merge_8 = Merge(Data1=cable_prestress_2)  # disabled
c_script = CSharpScript()  # -> out, name, min, max; disabled
# ---------- c_script: C# ----------
    decimal _max, _min;
    System.Guid _name;


    IGH_Param tempPara = this.Component.Params.Input[0].Sources[0];
    //if (tempPara.GetType() == typeof(Grasshopper.Kernel.Special.GH_NumberSlider))
    //{
    Grasshopper.Kernel.Special.GH_NumberSlider NumSlider = tempPara as Grasshopper.Kernel.Special.GH_NumberSlider;
    _max = NumSlider.Slider.Maximum;
    _min = NumSlider.Slider.Minimum;
    _name = NumSlider.InstanceGuid;
    //}
    
    name = _name;
    min = _min;
    max = _max;
# ---------- end c_script ----------
readsliders = CSharpScript(S=merge_8)  # -> out, N, D; inputs S: list; disabled
# ---------- readsliders: C# ----------
    IGH_Param mergeOutputParam = this.Component.Params.Input[0].Sources[0];
    var mergeComp = mergeOutputParam.Attributes.GetTopLevel.DocObject as IGH_Component;
    var sliders = mergeComp.Params.Input;

    List<string> nicknames = new List<string>();
    List<Interval> domains = new List<Interval>();

    foreach (var slider in sliders)
    {
      var sliderSource = slider.Sources[0];
      nicknames.Add(sliderSource.NickName);

      Grasshopper.Kernel.Special.GH_NumberSlider NumSlider = sliderSource as Grasshopper.Kernel.Special.GH_NumberSlider;
      //var _max = NumSlider.Slider.Maximum;
      Interval sliderDomain = new Interval ((double) NumSlider.Slider.Minimum, (double) NumSlider.Slider.Maximum);
      //_min = NumSlider.Slider.Minimum;
      domains.Add(sliderDomain);
    }


    N = nicknames;
    D = domains;
# ---------- end readsliders ----------
number_slider_20 = Slider(5, range=1..10)  # disabled
number_slider_21 = Slider(5, range=1..10)  # disabled
number_slider_22 = Slider(5, range=1..12)  # disabled
item_9 = ListItem(List=readsliders.D, Index=0, Wrap=True)  # -> Item, Item1, Item2, Item3; disabled
range = Range(Domain=item_9.Item, Steps=number_slider_20)  # -> simplify(Range); disabled
range_2 = Range(Domain=item_9.Item1, Steps=number_slider_21)  # -> simplify(Range); disabled
range_3 = Range(Domain=item_9.Item2, Steps=number_slider_22)  # -> simplify(Range); disabled
parameter_labels = Text(readsliders.N)  # disabled

# ----
panel_30 = Panel(readsliders.out)  # disabled
range_4 = Range(Domain=item_9.Item3, Steps=number_slider_7)  # -> simplify(Range); disabled

# ---- group: ACORN sampler (continued)
crossref = CrossReference(ListC=range, ListA=range_2, ListB=range_3, ListD=range_4, CrossMode=1)  # -> ListC, ListA, ListB, ListD; disabled
entwine_3 = Entwine(Branch0X=crossref.ListC, Branch1X=crossref.ListA, Branch2X=crossref.ListB, Branch3X=crossref.ListD, FlattenInputs=False)  # -> simplify(Result); disabled
flip = FlipMatrix(Data=entwine_3)  # disabled
panel_31 = Panel(flip)  # disabled
design_map = Number(flip)  # disabled

# ---- group: for generating catalog (= Sift in DSE)
number_slider_23 = Slider(97, range=0..97)  # disabled
branch = TreeBranch(Tree=design_map, Path=number_slider_23, MaintainPaths=True)  # disabled

# ----
current_solution = Integer(number_slider_23)  # disabled
panel_32 = Panel(parameter_labels)  # disabled
item_10 = ListItem(List=branch, Index=0, Wrap=True)  # -> Item, Item1, Item2, Item3; disabled

# ----
# Analyse segmented shell
number_slider_24 = Slider(0.01, range=0..0.1)
segments_2 = Surface(graft(a_segment))
cables = Curve(entwine)  # disabled
segments_3 = Geometry(flatten(segments_2))
gap_size = Number(number_slider_24)
offset_surface_for_gap = OffsetSurfaceForGap(srf=segments_3, gap_size=gap_size)  # -> simplify(i)
cables_2 = BooleanToggle(False)
distance_between_connections = Slider(0.039, range=0..1)
segments_4 = Surface(segments_3)

wip_alternative_offset_meshing = WIPAlternativeOffsetMeshing(segments=segments_3, offset_segments=offset_surface_for_gap)

# ----
# if input cables disabled, split segments is same as input segments
cables_3 = Curve(cables)

embed_cables = EmbedCables(segments=offset_surface_for_gap, cables=cables_3)  # -> split_segments_2, split_cables_2
filter_2 = StreamFilter(Gate=cables_2, Stream0=offset_surface_for_gap, Stream1=embed_cables.split_segments_2)
split_cables = Geometry(embed_cables.split_cables_2)
mesh_segments = MeshSegments(offset_segments=filter_2, mesh_resolution=Slider(0.2, range=0..0.3))
segments_mesh = Mesh(mesh_segments)
make_springs = MakeSprings(conn_dist=distance_between_connections, segments=segments_4, segments_mesh=segments_mesh)
karamba = Karamba(springs=make_springs, mesh=segments_mesh)

# ---- group: PT in mesh for Karamba
curveclosestmeshvert = CurveClosestMeshVert(segments=segments_mesh, cables=split_cables, tol=Slider(0.01, range=0..0.1))  # -> simplify(polyline_2)
posttensioning = PostTensioning(pt_force=Slider(16.618, range=0..100), cables=curveclosestmeshvert)  # -> simplify(pt_intersection_nodes_3), vec_pt_force_4, vec_end_force_2

# ----
# Visualise building
shell_bottom_height = Slider(2.6, range=0..10)
shell_bottom_height_2 = Number(shell_bottom_height)
thickness_m_6 = Number(thickness_m)
segments_5 = Surface(a_segment)
Z_3 = UnitZ(Factor=shell_bottom_height_2)
move_5 = Move(Geometry=segments_5, Motion=Z_3)  # -> Geometry, Transform
flatten_floor = FlattenFloor(segments=move_5.Geometry)
fillet_edges = BooleanToggle(False)
column_height = Slider(3, range=0..10)
column_radius = Slider(0.1, range=0..1)

c_script_2 = CSharpScript(
    bayGeometry=bay_geometry,
    segments=segments_5,
    thickness=thickness_m_6,
    cornerRadius=number_slider_2,
    columnHeight=number_slider_18,
    filletEdges=toggle_2)  # -> out, A, B, C, D, E, F; inputs bayGeometry: Polyline, segments: list of Brep, thickness: Double, cornerRadius: Double, columnHeight: Double, filletEdges: Boolean; disabled
# ---------- c_script_2: C# usings ----------
using System.Linq;
using Rhino.Geometry.Intersect;
# ---------- c_script_2: C# ----------
    double tol = RhinoDoc.ActiveDoc.ModelAbsoluteTolerance;

    // ----------- thicken segments ------------ //

    //bool filletEdges = false;

    double filletRadius = 0.02; // make input? // depend on thickness
    if (filletRadius > thickness / 3) filletRadius = thickness / 3; // ensure radius is smaller then thickness

    Curve path = new Line(Point3d.Origin, Vector3d.ZAxis, thickness).ToNurbsCurve();

    List<Brep> thickSegments = new List<Brep>();
    foreach (Brep segment in segments)
    {
      // add thickness upwards

      Brep thickSegment = segment.Faces[0].CreateExtrusion(path, true);

      if (filletEdges){
        // add fillet edges to segments (for viz)
        int numberOfEdges = thickSegment.Edges.Count;
        int[] edgeIndices = new int[numberOfEdges];
        double[] startRadii = new double[numberOfEdges];
        double[] endRadii = new double[numberOfEdges];

        for (int i = 0; i < numberOfEdges; i++)
        {
          edgeIndices[i] = i;
          startRadii[i] = filletRadius;
          endRadii[i] = filletRadius;
        }

        var filletResult = Brep.CreateFilletEdges(
          thickSegment,
          edgeIndices,
          startRadii,
          endRadii,
          BlendType.Fillet,
          RailType.RollingBall,
          tol);
        if (filletResult != null)
          thickSegment = filletResult[0];


      }

      thickSegments.Add(thickSegment);
    }

    // -------------- flat floor -------------- //

    // extract original surface by untrimming one segment
    Brep singleSegment = segments[0];
    Surface shell = singleSegment.Faces[0].UnderlyingSurface();

    // get bounding box from segments
    BoundingBox segmentsUnionBox = new BoundingBox();
    foreach (var segment in thickSegments)
      segmentsUnionBox = BoundingBox.Union(segmentsUnionBox, segment.GetBoundingBox(false));

    // get topmost point (?)
    Point3d apex = segmentsUnionBox.PointAt(0.5, 0.5, 1.0);
    PolylineCurve bayCurve = (PolylineCurve) bayGeometry.ToPolylineCurve();
    PolylineCurve floorCrv = (PolylineCurve) bayCurve.Duplicate();
    double shellHeight = apex.Z;
    floorCrv.Translate(new Vector3d (0, 0, shellHeight));
    Brep floorSrf = Brep.CreatePlanarBreps(floorCrv, tol)[0];
    Brep floorBrep = floorSrf.Faces[0].CreateExtrusion(path, true);


    // -------------- floor spacers ---------------- //

    // make floorSpacers
    //List<Point3d> floorPts = new List<Point3d>();
    List<Brep> spacers = new List<Brep>();
    int nrPts = 10;
    double ptDist = (double) 1 / nrPts;

    for (double i = ptDist / 2; i < 1; i += ptDist)
      for (double j = ptDist / 2; j < 1; j += ptDist){
        Point3d pt = segmentsUnionBox.PointAt(i, j, 1);

        // only project points inside bayGeometry
        PointContainment ptIn = floorCrv.Contains(pt, Plane.WorldXY, tol);
        if (ptIn == PointContainment.Inside){

          Point3d projPt = Intersection.ProjectPointsToBreps(
            new List<Brep>{shell.ToBrep()},
            new List<Point3d>{pt},
            new Vector3d(0, 0, -1),
            tol)[0];

          Line axis = new Line (projPt, pt);

          Brep spacer = Brep.CreatePipe(
            axis.ToNurbsCurve(), thickness / 2, false, PipeCapMode.None, false, tol, tol)[0];
          spacer.Translate(new Vector3d(0, 0, thickness / 2));
          spacers.Add(spacer);
        }
      }

    // ------------ make columns --------------- //
    //double columnHeight = 3;
    double columnHeadHeight = cornerRadius * 1.5;
    double columnRadius = cornerRadius / 2;
    List<Brep> columns = new List<Brep>();
    List<Brep> columnHeads = new List<Brep>();
    foreach (Point3d corner in bayGeometry){
      Line columnAxis = new Line (corner, new Vector3d (0, 0, columnHeight));
      Brep column = Brep.CreatePipe(columnAxis.ToNurbsCurve(), columnRadius, false, PipeCapMode.None, false, tol, tol)[0];
      column = column.CapPlanarHoles(tol);
      columns.Add(column);


      Curve topColumnHead = new Circle(corner, cornerRadius).ToNurbsCurve();
      Curve bottomColumnHead = new Circle(corner, columnRadius).ToNurbsCurve();
      bottomColumnHead.Translate(new Vector3d (0, 0, -columnHeadHeight));
      Brep columnHead = Brep.CreateFromLoft(
        new List<Curve>{bottomColumnHead, topColumnHead},
        Point3d.Unset, Point3d.Unset, LoftType.Straight, false)[0];
      columnHead = columnHead.CapPlanarHoles(tol);
      columnHeads.Add(columnHead);
    }

    // missing: translate all up; add tierods

    // ------- make Tierods ----------- //

    PolylineCurve tierodCurve = (PolylineCurve) bayCurve.Duplicate();
    tierodCurve.Translate(new Vector3d (0, 0, -thickness));
    Brep tierods = Brep.CreatePipe(tierodCurve, thickness / 2, false, PipeCapMode.None, false, tol, tol)[0];



    // move everything up: thickSegments, floorBrep, spacers, columnHeads, tierods

    double freeHeight = columnHeight - shellHeight - thickness;
    foreach (Brep brep in thickSegments)
      brep.Translate(0, 0, freeHeight);
    floorBrep.Translate(0, 0, freeHeight);
    foreach (Brep brep in spacers)
      brep.Translate(0, 0, freeHeight);
    foreach (Brep brep in columnHeads)
      brep.Translate(0, 0, freeHeight);
    tierods.Translate(0, 0, freeHeight);



    A = thickSegments;
    B = floorBrep;
    C = spacers;
    D = columns;
    E = columnHeads;
    F = tierods;
# ---------- end c_script_2 ----------
a_vizbldg = VisualiseBuilding(
    BayGeometry=bay_geometry,
    Segments=segments_5,
    Thickness=thickness_m_6,
    CornerRadius=number_slider_2,
    ColumnHeight=number_slider_18,
    FilletEdges=toggle_2)  # -> ThickSegments, Floor, Spacers, Columns, ColumnHeads, TieRods
thickness_2 = Number(thickness_m_6)
segments_6 = Surface(move_5.Geometry)
Z_4 = UnitZ(Factor=thickness_2)
fillet_edges_2 = Boolean(fillet_edges)
extr = Extrude(Base=segments_6, Direction=Z_4)
brep_2 = Brep(extr)
dispatch = Dispatch(List=brep_2, DispatchPattern=fillet_edges_2)  # -> ListA, ListB

# ---- group: enable for filleted edges
edges_6 = BrepEdges(Brep=brep_2)  # -> Naked, Interior, NonManifold
lng_6 = ListLength(List=edges_6.Interior)
series_3 = Series(Start=0, Step=1, Count=lng_6)  # -> simplify(Series)
filedge = FilletEdge(Shape=dispatch.ListA, Blend=0, Metric=0, Edges=series_3, Radii=Slider(0.02, range=0..0.03))

# ----
filter_3 = StreamFilter(Gate=fillet_edges_2, Stream0=brep_2, Stream1=filedge)
bbox_3 = BoundingBox(Content=flatten(filter_3), Plane=PlaneXY(0, 0, 0), UnionBox=True)  # -> Box, Box_2
box_corners = BoxCorners(Box=bbox_3.Box)  # -> CornerA, CornerB, CornerC, CornerD, CornerE, CornerF, CornerG, CornerH
merge_9 = Merge(Data1=box_corners.CornerA, Data2=box_corners.CornerB, Data3=box_corners.CornerC, Data4=box_corners.CornerD)
shell_segments = Brep(filter_3)
corner_points = Point(merge_9)

make_columns = MakeColumns(corner_points=corner_points, column_radius=column_radius, column_total_height=column_height)  # -> columns_2, column_tops_2
bracing = Bracing(columns=make_columns.columns_2)  # -> wall_diagonals_3, top_diagonals_3, top_edges_3
merge_10 = Merge(Data1=bracing.wall_diagonals_3, Data2=bracing.top_diagonals_3, Data3=bracing.top_edges_3)
merge_11 = Merge(Data1=shell_segments, Data2=make_columns.columns_2, Data3=make_columns.column_tops_2)
merge_12 = Merge(Data1=merge_10, Data2=flatten_floor)
steel = Geometry(merge_12)
concrete = Geometry(merge_11)
preview_3 = CustomPreview(Geometry=steel, Material=ColourSwatch(SwatchColor=RGB(117, 117, 117)))
preview_4 = CustomPreview(Geometry=concrete, Material=ColourSwatch(SwatchColor=RGB(207, 207, 207)))

# ==== cluster GetProjectedSegments
maximum_deviation = ClusterInput()
local_optimization = ClusterInput()
stress_lines = ClusterInput()
rho_values = ClusterInput()
phi_values = ClusterInput()
shell = ClusterInput()
shell_2 = Brep(shell)
stress_lines_2 = Curve(stress_lines)
rho_values_2 = Number(rho_values)
maximum_deviation_2 = Number(maximum_deviation)
local_optimization_2 = Boolean(local_optimization)
phi_values_2 = Number(phi_values)
shell_3 = Brep(shell_2)
edges = BrepEdges(Brep=shell_3)  # -> Naked, Interior, NonManifold

# ---- group: [OBSOLETE] intersect and polygonize
bang = ExplodeTree(Data=stress_lines_2)  # -> Branch0, Branch1; disabled
edge_cables = Curve(bang.Branch1)  # disabled
corner_cables = Curve(bang.Branch0)  # disabled
ccx = CurveCurve(CurveA=simplify(graft(corner_cables)), CurveB=edge_cables)  # -> Points, ParamsA, ParamsB; disabled
ccx_2 = CurveCurve(CurveA=corner_cables, CurveB=simplify(graft(edge_cables)))  # -> Points, ParamsA, ParamsB; disabled
trim = TrimTree(Tree=ccx.Points, Depth=1)  # disabled
trim_2 = TrimTree(Tree=ccx_2.Points, Depth=1)  # disabled
alongcrv = SortAlongCurve(Points=trim, Curve=graft(corner_cables))  # -> Points, Indices; disabled
alongcrv_2 = SortAlongCurve(Points=trim_2, Curve=graft(edge_cables))  # -> Points, Indices; disabled
pline = PolyLine(Vertices=alongcrv.Points, Closed=False)  # disabled
pline_2 = PolyLine(Vertices=alongcrv_2.Points, Closed=False)  # disabled
merge = Merge(Data1=pline, Data2=pline_2)  # -> simplify(Result); disabled
trim_3 = TrimTree(Tree=merge, Depth=1)  # disabled
poly_cables = Curve(flatten(trim_3))  # disabled

# ----
project = Project(Geometry=edges.Naked, Plane=PlaneXY(0, 0, 0))  # -> Geometry, Transform
join = JoinCurves(Curves=project.Geometry, Preserve=False)
intersect_stress_lines = IntersectStressLines(stress_lines=stress_lines_2)
surface_plan = Curve(join)
jiggle_points = JigglePoints(
    intersection_points=intersect_stress_lines,
    maximum_deviation=maximum_deviation_2,
    phi_values=phi_values_2,
    rho_values=rho_values_2,
    curves_to_snap=surface_plan)
intersection_points = Point(intersect_stress_lines)
local_optimization_3 = Boolean(local_optimization_2)
jiggled_points = Point(jiggle_points)
filter = StreamFilter(Gate=local_optimization_3, Stream0=intersection_points, Stream1=jiggled_points)
make_segments = MakeSegments(stress_lines=stress_lines_2, intersection_points=filter, tolerance=maximum_deviation_2)
make_keystone = MakeKeystone(surface_plan=surface_plan, intersection_points=filter)
merge_2 = Merge(Data1=make_keystone, Data2=make_segments)  # -> flatten(Result)
brep = Brep(surface_plan)
srfsplit = SurfaceSplit(Surface=brep, Curves=merge_2)
straight_proj_segments = Surface(srfsplit)
straight_proj_segments_2 = ClusterOutput(straight_proj_segments)

# ==== cluster StaticSegmentations
manualopt02_1_4 = Curve([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])
manualopt01 = Curve([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])
xz = XZPlane(Origin=Point(0, 0, 0))
crv = Curve(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)
_6x6_segments = Surface([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])
lor_segments = Surface([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])
geo = Geometry(manualopt02_1_4)
mirror = Mirror(Geometry=geo, Plane=xz)  # -> Geometry, Transform
edges = BrepEdges(Brep=lor_segments)  # -> Naked, Interior, NonManifold
merge = Merge(Data1=geo, Data2=mirror.Geometry)
yz = YZPlane(Origin=Point(0, 0, 0))
join = JoinCurves(Curves=edges.Naked, Preserve=False)
mirror_2 = Mirror(Geometry=merge, Plane=yz)  # -> Geometry, Transform
merge_2 = Merge(Data1=merge, Data2=mirror_2.Geometry, Data3=crv)
boundary = BoundarySurfaces(Edges=merge_2)
segments = Surface(_6x6_segments)
segments_2 = ClusterOutput(segments)

# ==== cluster SegmentSubdivisionWIP
split_direction = ClusterInput()
proj_segments = ClusterInput()
shell = ClusterInput()
model = ClusterInput()
shell_2 = Surface(shell)
model_2 = ModelKaramba3D(model)
split_direction_2 = Integer(split_direction)
proj_segments_2 = Surface(proj_segments)
split_to_corner = Slider(0.646, range=0..1)  # disabled
split_to_edge = Slider(0.5, range=0..1)
num = Number(split_to_corner)
merge = Merge(Data1="0", Data2=num, Data3="1")

srf = Surface(proj_segments_2)
bbox = BoundingBox(Content=srf, Plane=PlaneXY(0, 0, 0), UnionBox=True)  # -> Box, Box_2
area = Area(Geometry=bbox.Box)  # -> Area, Centroid
box_corners = BoxCorners(Box=bbox.Box)  # -> CornerA, CornerB, CornerC, CornerD, CornerE, CornerF, CornerG, CornerH
panel = Panel("exclude keystone + cornerstones")
merge_2 = Merge(Data1=box_corners.CornerA, Data2=box_corners.CornerB, Data3=box_corners.CornerC, Data4=box_corners.CornerD)
area_2 = Area(Geometry=srf)  # -> Area, Centroid; disabled
merge_3 = Merge(Data1=area.Centroid, Data2=merge_2)

debrep = DeconstructBrep(Brep=srf)  # -> Faces, Edges, simplify(Vertices)
join = JoinCurves(Curves=debrep.Edges, Preserve=False)  # -> simplify(Curves)
area_3 = Area(Geometry=join)  # -> Area, flatten(Centroid)

cp = ClosestPoint(Point=merge_3, Cloud=area_3.Centroid)  # -> ClosestPoint, CPIndex, Distance
cull_i = CullIndex(List=srf, Indices=cp.CPIndex, Wrap=True)

item = ListItem(List=cull_i, Index=Slider(7, range=0..10), Wrap=True)

# ----
# rebuild segment surfaces with appropriate UV space
srf_2 = Surface(simplify(graft(cull_i)))
crv = Curve(srf_2)
bbox_2 = BoundingBox(Content=flatten(crv), Plane=PlaneXY(0, 0, 0), UnionBox=True)  # -> Box, Box_2
area_4 = Area(Geometry=crv)  # -> Area, Centroid
volume = Volume(Geometry=bbox_2.Box)  # -> Volume, Centroid
vec2pt = Vector2Pt(PointA=area_4.Centroid, PointB=volume.Centroid, Unitize=False)  # -> Vector, Length
loft_opt = LoftOptions(Closed=False, Adjust=Toggle(True), Rebuild=0, Refit=0, Type=0)

simplify = SimplifyCurve(Curve=crv)  # -> Curve, Simplified

# ---- group: to which support should each segment look at
# get support points
# (temporary, only works for rectangles)
# determine edge closest to support
srf_3 = Surface(srf_2)
bbox_3 = BoundingBox(Content=flatten(srf_3), Plane=PlaneXY(0, 0, 0), UnionBox=True)  # -> Box, Box_2
box_corners_2 = BoxCorners(Box=bbox_3.Box)  # -> CornerA, CornerB, CornerC, CornerD, CornerE, CornerF, CornerG, CornerH
merge_4 = Merge(Data1=box_corners_2.CornerA, Data2=box_corners_2.CornerB, Data3=box_corners_2.CornerC, Data4=box_corners_2.CornerD)
area_5 = Area(Geometry=srf_3)  # -> Area, Centroid; disabled

# ----
debrep_2 = DeconstructBrep(Brep=srf_3)  # -> Faces, Edges, simplify(Vertices)
join_2 = JoinCurves(Curves=debrep_2.Edges, Preserve=False)  # -> simplify(Curves)
area_6 = Area(Geometry=join_2)  # -> Area, Centroid

# ---- group: to which support should each segment look at (continued)
cp_2 = ClosestPoint(Point=area_6.Centroid, Cloud=merge_4)  # -> ClosestPoint, CPIndex, Distance

# ----
vec2pt_2 = Vector2Pt(PointA=area_4.Centroid, PointB=cp_2.ClosestPoint, Unitize=False)  # -> Vector, Length
explode = Explode(Curve=simplify.Curve, Recursive=True)  # -> simplify(Segments), simplify(Vertices)
pl = ConstructPlane(Origin=area_4.Centroid, XAxis=vec2pt_2.Vector, YAxis=vec2pt.Vector)
cull_i_2 = CullIndex(List=explode.Vertices, Indices="0", Wrap=True)
cir = Circle(Plane=pl, Radius="0.2")
alongcrv = SortAlongCurve(Points=cull_i_2, Curve=cir)  # -> Points, Indices
item_2 = ListItem(List=alongcrv.Points, Index=0, Wrap=True)  # -> Item, Item1, Item2, Item3
ln = Line(StartPoint=item_2.Item3, EndPoint=item_2.Item2)
ln_2 = Line(StartPoint=item_2.Item, EndPoint=item_2.Item1)
merge_5 = Merge(Data1=ln_2, Data2=ln)  # -> simplify(Result)
loft = Loft(Curves=merge_5, Options=loft_opt)

# ---- group: number points in closed polyline
pt = Point(simplify(alongcrv.Points))
pline = PolyLine(Vertices=pt, Closed="True")
area_7 = Area(Geometry=pline)  # -> Area, simplify(Centroid)
vec2pt_3 = Vector2Pt(PointA=pt, PointB=area_7.Centroid, Unitize="True")  # -> Vector, Length
lng = ListLength(List=pt)
multiplication = Multiplication(A=vec2pt_3.Vector, B=Slider(0.312, range=0..1))
move = Move(Geometry=pt, Motion=multiplication)  # -> Geometry, Transform
series = Series(Start=0, Step=1, Count=lng)
tag = TextTag(Location=move.Geometry, Text=series)

# ---- group: split using PSlines
md_slider = MDSlider(SliderMode=0, slider_value=Point(0.5, 0.5, 0.5), x_domain=Domain(0, 1), y_domain=Domain(0, 1), z_domain=Domain(0, 1))
srf_4 = Surface(loft)
evalsrf = EvaluateSurface(Surface=reparameterize(srf_4), Point=md_slider)  # -> Point, Normal, UDirection, VDirection, Frame
Z = UnitZ(Factor=1)
shell_3 = Surface(shell_2)
project = ProjectPoint(Point=evalsrf.Point, Direction=Z, Geometry=shell_3)  # -> Point, Index
model_3 = ModelKaramba3D(model_2)
shelllineresults = LineResultsOnShellsKaramba3D(
    AnalyzedModel=model_3,
    LayerPosition=Slider(0, range=-1..1),
    ListOfSourcesOfPrincipalStressLinesLinesPoints=project.Point,
    SegmentLength_m=0.5,
    DA_deg=5,
    mode="PrincStress")  # -> AnalyzedModel, Lines1, Lines2
crv_2 = Curve(shelllineresults.Lines2)
crv_3 = Curve(shelllineresults.Lines1)
trim = TrimTree(Tree=simplify(crv_3), Depth=1)
trim_2 = TrimTree(Tree=simplify(crv_2), Depth=1)
join_3 = JoinCurves(Curves=trim, Preserve=False)
join_4 = JoinCurves(Curves=trim_2, Preserve=False)
project_2 = Project(Geometry=join_3, Plane=PlaneXY(0, 0, 0))  # -> simplify(Geometry), Transform
project_3 = Project(Geometry=join_4, Plane=PlaneXY(0, 0, 0))  # -> simplify(Geometry), Transform
split_direction_3 = Integer(split_direction_2)
merge_6 = Merge(Data1=project_2.Geometry, Data2=project_3.Geometry)
crv_4 = Curve(srf_4)
item_3 = ListItem(List=merge_6, Index=split_direction_3, Wrap=True)
ccx = CurveCurve(CurveA=crv_4, CurveB=item_3)  # -> Points, ParamsA, ParamsB
toggle = BooleanToggle(False)
pline_2 = PolyLine(Vertices=ccx.Points, Closed=False)
srfsplit = SurfaceSplit(Surface=srf_4, Curves=pline_2)

# ---- group: split to edge
srf_5 = Surface(loft)
divide = DivideDomain²(Domain=srf_5, UCount=Slider(1, range=1..2), VCount=Slider(2, range=1..2))
subsrf = Isotrim(Surface=srf_5, Domain=divide)

# ----
split_segments = Geometry(simplify(srfsplit))
split_segments_2 = ClusterOutput(split_segments)

# ---- group: split to both
num_2 = Number(split_to_edge)
srf_6 = Surface(loft)
merge_7 = Merge(Data1="0", Data2=num_2, Data3="1")
panel_2 = Panel("False")
consec = ConsecutiveDomains(Numbers=merge_7, Additive=panel_2)

# ----
consec_2 = ConsecutiveDomains(Numbers=merge, Additive=panel_2)
crossref = CrossReference(ListA=consec, ListB=consec_2, CrossMode=1)  # -> ListA, ListB

# ---- group: split to both (continued)
dom² = ConstructDomain²(DomainU=crossref.ListA, DomainV=crossref.ListB)
subsrf_2 = Isotrim(Surface=reparameterize(srf_6), Domain=dom²)

# ==== cluster FlattenFloor
segments = ClusterInput()

# ---- group: generate fl
segments_2 = Surface(segments)
item = ListItem(List=flatten(segments_2), Index=0, Wrap=True)
bbox = BoundingBox(Content=flatten(segments_2), Plane=PlaneXY(0, 0, 0), UnionBox=True)  # -> Box, Box_2
untrim = Untrim(Surface=item)
box = EvaluateBox(Box=bbox.Box, UParameter=0.5, VParameter=0.5, WParameter="1")  # -> Plane, Point, Include
sec = BrepPlane(Brep=bbox.Box, Plane=box.Plane)  # -> Curves, Points
neg = Negative(Value=Slider(0.442, range=0..1))
offset = OffsetCurve(Curve=sec.Curves, Distance=neg, Plane=PlaneXY(0, 0, 0), Corners=1)
Z = UnitZ(Factor=Slider(0.05, range=0..0.1))
boundary = BoundarySurfaces(Edges=sec.Curves)
boundary_2 = BoundarySurfaces(Edges=offset)
sdivide = DivideSurface(Surface=boundary_2, UCount=10, VCount=10)  # -> simplify(graft(Points)), Normals, Parameters
extr = Extrude(Base=boundary, Direction=Z)
project = ProjectPoint(Point=sdivide.Points, Direction=Vector(0, 0, -1), Geometry=untrim)  # -> Point, Index
number_slider = Slider(0.03, range=0..0.1)
merge = Merge(Data1=sdivide.Points, Data2=project.Point)
neg_2 = Negative(Value=number_slider)
pline = PolyLine(Vertices=merge, Closed=False)
ext = ExtendCurve(Curve=pline, Type=0, Start="0", End=neg_2)
pipe = Pipe(Curve=ext, Radius=number_slider, Caps=0)
merge_2 = Merge(Data1=extr, Data2=pipe)
flat_floor = Geometry(merge_2)

# ----
flat_floor_2 = ClusterOutput(flat_floor)

# ==== cluster Bracing
columns = ClusterInput()
columns_2 = Brep(columns)
bbox = BoundingBox(Content=columns_2, Plane=PlaneXY(0, 0, 0))  # -> Box, Box_2
boxsize = BoxSize(box=bbox.Box)  # -> X_2, Y_2, Z_2, A_2, V_2
brace_offset = Slider(0.15, range=0..0.2)
shell_bottom_height = Number(boxsize.Z_2)
subtraction = Subtraction(A=shell_bottom_height, B=brace_offset)
box = EvaluateBox(Box=bbox.Box, UParameter=0.5, VParameter=0.5, WParameter="0")  # -> Plane, Point, Include
Z = UnitZ(Factor=subtraction)
Z_2 = UnitZ(Factor=brace_offset)
pt = Point(box.Point)
move = Move(Geometry=pt, Motion=Z)  # -> Geometry, Transform
move_2 = Move(Geometry=pt, Motion=Z_2)  # -> Geometry, Transform
merge = Merge(Data1=move_2.Geometry, Data2=move.Geometry)
bbox_2 = BoundingBox(Content=merge, Plane=PlaneXY(0, 0, 0), UnionBox=True)  # -> Box, Box_2
pline = PolyLine(Vertices=move.Geometry, Closed=True)
box_corners = BoxCorners(Box=bbox_2.Box)  # -> CornerA, CornerB, CornerC, CornerD, CornerE, CornerF, CornerG, CornerH
box_corners_2 = BoxCorners(Box=bbox_2.Box)  # -> CornerA, CornerB, CornerC, CornerD, CornerE, CornerF, CornerG, CornerH
explode = Explode(Curve=pline, Recursive=True)  # -> Segments, Vertices
ln = Line(StartPoint=box_corners.CornerF, EndPoint=box_corners.CornerH)
ln_2 = Line(StartPoint=box_corners.CornerE, EndPoint=box_corners.CornerG)
ln_3 = Line(StartPoint=box_corners_2.CornerC, EndPoint=box_corners_2.CornerF)
ln_4 = Line(StartPoint=box_corners_2.CornerB, EndPoint=box_corners_2.CornerG)
ln_5 = Line(StartPoint=box_corners_2.CornerC, EndPoint=box_corners_2.CornerH)
ln_6 = Line(StartPoint=box_corners_2.CornerD, EndPoint=box_corners_2.CornerG)
merge_2 = Merge(Data1=ln_3, Data2=ln_4, Data3=ln_5, Data4=ln_6)
merge_3 = Merge(Data1=ln_2, Data2=ln)
top_edges = Geometry(explode.Segments)
wall_diagonals = Geometry(merge_2)
top_diagonals = Geometry(merge_3)
entwine = Entwine(Branch00=wall_diagonals, Branch01=top_diagonals, Branch02=top_edges, FlattenInputs=True)  # -> simplify(graft(Result))
merge_4 = Merge(Data1=wall_diagonals, Data2=top_diagonals, Data3=top_edges)  # -> flatten(Result)
number_slider = Slider(0.02, range=0..0.1)
crv = Curve(merge_4)
bcx = BrepCurve(Brep=flatten(columns_2), Curve=entwine)  # -> Curves, Points
pipe = Pipe(Curve=entwine, Radius=number_slider, Caps=0)  # -> simplify(Pipe)
multiplication = Multiplication(A=number_slider, B=Slider(1.3, range=1..2))
sph = Sphere(Base=bcx.Points, Radius=multiplication)  # -> simplify(Sphere)
trim = TrimTree(Tree=pipe, Depth=1)
trim_2 = TrimTree(Tree=sph, Depth="2")
bang = ExplodeTree(Data=trim)  # -> Branch0, Branch1, Branch2
bang_2 = ExplodeTree(Data=trim_2)  # -> Branch0, Branch1, Branch2
wall_diagonals_2 = Geometry([bang.Branch0, bang_2.Branch0])
top_diagonals_2 = Geometry([bang.Branch1, bang_2.Branch1])
top_edges_2 = Geometry([bang.Branch2, bang_2.Branch2])
top_diagonals_3 = ClusterOutput(top_diagonals_2)
wall_diagonals_3 = ClusterOutput(wall_diagonals_2)
top_edges_3 = ClusterOutput(top_edges_2)

# ==== cluster MakeColumns
corner_points = ClusterInput()
column_radius = ClusterInput()
column_total_height = ClusterInput()
corner_points_2 = Point(corner_points)
corner_points_3 = Point(corner_points_2)
column_radius_2 = Number(column_radius)
project = Project(Geometry=corner_points_3, Plane=PlaneXY(0, 0, 0))  # -> Geometry, Transform
column_total_height_2 = Number(column_total_height)
dist = Distance(PointA=simplify(graft(corner_points_3)), PointB=simplify(graft(project.Geometry)))  # -> flatten(Distance)
subtraction = Subtraction(A=column_total_height_2, B=dist)
column_height = Number(dist)
column_bottom = Point(project.Geometry)
column_top_height = Number(subtraction)
column_radius_3 = Number(column_radius_2)
Z = UnitZ(Factor=column_height)
multiplication = Multiplication(A=column_radius_3, B=Slider(2.3, range=0..10))
multiplication_2 = Multiplication(A=column_radius_3, B=Slider(4.4, range=0..10))
move = Move(Geometry=column_bottom, Motion=Z)  # -> Geometry, Transform
neg = Negative(Value=multiplication_2)
cyl = Cylinder(Base=column_bottom, Radius=column_radius_2, Length=column_height)
cyl_2 = Cylinder(Base=move.Geometry, Radius=column_radius_2, Length=column_top_height)
cone = Cone(Base=corner_points_2, Radius=multiplication, Length=neg)  # -> Cone, Tip
cyl_3 = Cylinder(Base=corner_points_2, Radius=Slider(0.2, range=0..1), Length=Slider(0.08, range=0..0.1))
cap = CapHoles(Brep=cone.Cone)
cap_2 = CapHoles(Brep=cyl_3)
cap_3 = CapHoles(Brep=cyl)
cap_4 = CapHoles(Brep=cyl_2)
merge = Merge(Data1=cap_2, Data2=cap, Data3=cap_3)
sunion = SolidUnion(Breps=merge)
column_tops = Brep(cap_4)
columns = Brep(sunion)
columns_2 = ClusterOutput(columns)
column_tops_2 = ClusterOutput(column_tops)

# ==== cluster OffsetSurfaceForGap
srf = ClusterInput()
test_surface = TestSurface()
gap_size = ClusterInput()
srf_2 = Surface(simplify(graft(srf)))
gap_size_2 = Number(gap_size)
division = Division(A=gap_size_2, B=2)
edges = BrepEdges(Brep=srf_2)  # -> simplify(Naked), Interior, NonManifold
offsets = OffsetOnSrf(Curve=edges.Naked, Distance=division, Surface=srf_2)
trim = TrimTree(Tree=offsets, Depth=1)
srfsplit = SurfaceSplit(Surface=srf_2, Curves=trim)
area = Area(Geometry=srfsplit)  # -> Area, Centroid
sort = SortList(Keys=area.Area, ValuesA=srfsplit)  # -> Keys, ValuesA
item = ListItem(List=reverse(sort.ValuesA), Index=0, Wrap=True)
i = ClusterOutput(item)

# ==== cluster MakeSprings
segments_mesh = ClusterInput()
segments = ClusterInput()
segments_2 = Surface(segments)
segments_mesh_2 = Mesh(flatten(segments_mesh))

# ---- group: determine internal edges + topology
join = BrepJoin(Breps=segments_2)  # -> Breps, Closed
debrep = DeconstructBrep(Brep=join.Breps)  # -> Faces, Edges, Vertices
topology = BrepTopology(Brep=join.Breps, PerspectiveOnly=False)  # -> FaceFaceAdjacency, FaceEdgeAdjacency, simplify(EdgeFaceAdjacency)
lng = ListLength(List=topology.EdgeFaceAdjacency)
larger = LargerThan(FirstNumber=lng, SecondNumber="2")  # -> LargerThan, OrEqualTo
dispatch = Dispatch(List=topology.EdgeFaceAdjacency, DispatchPattern=larger.OrEqualTo)  # -> ListA, ListB
clean = CleanTree(RemoveNulls=True, RemoveInvalid=True, RemoveEmpty=Toggle(True), Tree=dispatch.ListA)
tstat = TreeStatistics(Tree=clean)  # -> Paths, Length, Count
dpath = DeconstructPath(Branch=tstat.Paths)
item = ListItem(List=debrep.Edges, Index=flatten(dpath), Wrap=True)
match = MatchTree(Tree=graft(item), Guide=clean)
adjacent_faces = Integer(clean)
internal_edges = Curve(match)

# ---- group: determine gap size
segments_mesh_3 = Mesh(graft(segments_mesh_2))
segments_3 = Surface(graft(segments_2))
medges = MeshEdges(Mesh=segments_mesh_3)  # -> NakedEdges, InteriorEdges, NonManifoldEdges
debrep_2 = DeconstructBrep(Brep=segments_3)  # -> Faces, Edges, Vertices
join_2 = JoinCurves(Curves=medges.NakedEdges, Preserve=False)  # -> simplify(Curves)
join_3 = JoinCurves(Curves=debrep_2.Edges, Preserve=False)  # -> simplify(Curves)
explode = Explode(Curve=join_2, Recursive=True)  # -> Segments, Vertices
pt = Point(explode.Vertices)
crv_cp = CurveClosestPoint(Point=pt, Curve=join_3)  # -> Point, Parameter, Distance
sort = SortList(Keys=crv_cp.Distance)  # -> Keys, ValuesA
item_2 = ListItem(List=sort.Keys, Index=0, Wrap=True)
avr = Average(Input=flatten(item_2))
multiplication = Multiplication(A=avr, B=2)
gap_size = Number(multiplication)

# ----
gap_size_2 = Number(gap_size)

# ---- group: mesh vertices on curves
item_3 = ListItem(List=segments_mesh_2, Index=adjacent_faces, Wrap=True)
crv = Curve(internal_edges)
demesh = DeconstructMesh(Mesh=item_3)  # -> Vertices, Faces, Colours, Normals
repeat = RepeatData(Data=crv, Length="2")  # -> simplify(graft(Data))
pull = PullPoint(Point=demesh.Vertices, Geometry=repeat, ClosestOnly=True)  # -> ClosestPoint, Distance
smaller = SmallerThan(FirstNumber=pull.Distance, SecondNumber=gap_size_2)  # -> SmallerThan, OrEqualTo
cull = CullPattern(List=demesh.Vertices, CullPattern=smaller.SmallerThan)  # -> simplify(List)
alongcrv = SortAlongCurve(Points=cull, Curve=repeat)  # -> simplify(Points), Indices

# ----
number_slider = Slider(0.221, range=0..3)
conn_dist = ClusterInput()
conn_dist_2 = Number(conn_dist)

# ---- group: select points according to connection distance (approx.)
shatter = Shatter(Curve=reparameterize(repeat), Parameters=".5")  # -> simplify(Segments)
item_4 = ListItem(List=shatter, Index=0, Wrap=True)  # -> Item, Item1
flip = FlipCurve(Curve=item_4.Item)  # -> Curve, Flag
merge = Merge(Data1=flip.Curve, Data2=item_4.Item1)
divlength = DivideLength(Curve=merge, Length=conn_dist_2)  # -> simplify(Points), Tangents, Parameters
trim = TrimTree(Tree=divlength.Points, Depth=1)
rdpoints = RemoveDuplicatePointsKaramba3D(Point=trim, LimitDistance=0.005)  # -> OutPoint, Info, Indexes

# ----
cp = ClosestPoint(Point=rdpoints.OutPoint, Cloud=alongcrv.Points)  # -> ClosestPoint, CPIndex, Distance
rdpoints_2 = RemoveDuplicatePointsKaramba3D(Point=cp.ClosestPoint, LimitDistance=0.005)  # -> OutPoint, Info, Indexes
pt_2 = Point(simplify(graft(rdpoints_2.OutPoint)))
path_mapper = PathMapper(pt_2, source="{A;B;C}", target="{A;C;B}")
pt_3 = Point(path_mapper)
trim_2 = TrimTree(Tree=pt_3, Depth=1)
item_5 = ListItem(List=trim_2, Index=0, Wrap=True)  # -> Item, Item1
ln = Line(StartPoint=item_5.Item, EndPoint=item_5.Item1)
springs = Line(ln)
springs_2 = ClusterOutput(springs)
spring_angles = SpringAngles(crv=springs)

# ==== cluster CurveClosestMeshVert
number_slider = Slider(8, range=0..100)
segments = ClusterInput()
cables = ClusterInput()
tol = ClusterInput()
tol_2 = Number(tol)
segments_2 = Mesh(segments)
number_slider_2 = Slider(0.01, range=0..0.01)
cables_2 = Curve(cables)
branch = TreeBranch(Tree=segments_2, Path=number_slider, MaintainPaths=True)
branch_2 = TreeBranch(Tree=cables_2, Path=number_slider, MaintainPaths=True)
mesh = Mesh(segments_2)
curve = Curve(cables_2)

# ---- group: exclude segments without cables
tstat = TreeStatistics(Tree=cables_2)  # -> Paths, Length, Count
branch_3 = TreeBranch(Tree=mesh, Path=tstat.Paths, MaintainPaths=True)

# ----
deconstruct_mesh = DeconstructMesh(Mesh=branch_3)  # -> simplify(Vertices), Faces, Colours, Normals

# ---- group: "manual" cross reference
group = Group(Objects=deconstruct_mesh.Vertices)
lng = ListLength(List=curve)
repeat = RepeatData(Data=group, Length=lng)  # -> simplify(Data)
ungroup = Ungroup(Group=repeat)

# ----
curve_2 = Curve(graft(curve))
pull = PullPoint(Point=ungroup, Geometry=curve_2, ClosestOnly=True)  # -> ClosestPoint, Distance
smaller = SmallerThan(FirstNumber=pull.Distance, SecondNumber=tol_2)  # -> SmallerThan, OrEqualTo
dispatch = Dispatch(List=pull.ClosestPoint, DispatchPattern=smaller.SmallerThan)  # -> ListA, ListB
pt = Point(dispatch.ListA)
sort_along_curve = SortAlongCurve(Points=pt, Curve=curve_2)  # -> simplify(Points), Indices
cullpt = CullDuplicates(Points=sort_along_curve.Points, Tolerance=tol_2, CullMode=3)  # -> Points, Indices, Valence
polyline = PolyLine(Vertices=cullpt.Points, Closed=False)
polyline_2 = ClusterOutput(polyline)

# ==== cluster PostTensioning
cables = ClusterInput()
pt_force = ClusterInput()
cables_2 = Geometry(cables)
pt_force_2 = Number(pt_force)

# ----
# PT forces
pt_kn = Number(pt_force_2)
crv = Curve(cables_2)
flip = FlipCurve(Curve=crv)  # -> Curve, Flag
explode = Explode(Curve=crv, Recursive=True)  # -> Segments, simplify(Vertices)
crv_2 = Curve(crv)
lng = ListLength(List=explode.Vertices)
series = Series(Start=0, Step=1, Count=lng)  # -> simplify(Series)
int = Integer(series)
neg = Negative(Value=int)
eval = EvaluateCurve(Curve=graft(crv_2), Parameter=int)  # -> Point, Tangent, Angle
eval_2 = EvaluateCurve(Curve=graft(flip.Curve), Parameter=neg)  # -> Point, Tangent, Angle
pt_intersection_nodes = Point(eval.Point)

intcrv = Interpolate(Vertices=explode.Vertices, Degree=3, Periodic=False, KnotStyle=1)  # -> Curve, Length, Domain
nurbs = NurbsCurve(Vertices=explode.Vertices, Degree=3, Periodic=False)  # -> Curve, Length, Domain
crvgraph = CurvatureGraph(Curve=intcrv.Curve, Density=5, Scale=Slider(103, range=0..120))
crossref = CrossReference(ListA=graft(pt_kn), ListB=eval.Point, CrossMode=1)  # -> ListA, ListB

amp = Amplitude(Vector=eval_2.Tangent, Amplitude=simplify(crossref.ListA))
amp_2 = Amplitude(Vector=eval.Tangent, Amplitude=simplify(crossref.ListA))
addition = Addition(A=amp_2, B=amp)
vdis = VectorDisplay(Anchor=pt_intersection_nodes, Vector=amp)
vdis_2 = VectorDisplay(Anchor=pt_intersection_nodes, Vector=amp_2)
vec_pt_force = Vector(addition)
vdis_3 = VectorDisplay(Anchor=pt_intersection_nodes, Vector=vec_pt_force)

item = ListItem(List=reverse(amp_2), Index=0, Wrap=True)
item_2 = ListItem(List=reverse(eval.Point), Index=0, Wrap=True)
item_3 = ListItem(List=eval_2.Point, Index=0, Wrap=True)
item_4 = ListItem(List=amp, Index=0, Wrap=True)
vdis_endforce = VectorDisplay(Anchor=item_2, Vector=item)
vdis_endforce_2 = VectorDisplay(Anchor=item_3, Vector=item_4)
merge = Merge(Data1=item, Data2=item_4)
pt_intersection_nodes_2 = Point(pt_intersection_nodes)
vec_end_force = Vector(merge)
vec_pt_force_2 = Vector(addition)
vec_end_force_2 = ClusterOutput(vec_end_force)
move = Move(Geometry=pt_intersection_nodes_2, Motion=vec_pt_force_2)  # -> Geometry, Transform

# ---- group: pair up curve intersection points by index, returns uniques
vec_pt_force_3 = Vector(flatten(vec_pt_force))
pt = Point(flatten(pt_intersection_nodes))
rdpoints = RemoveDuplicatePointsKaramba3D(Point=pt, LimitDistance=0.005)  # -> OutPoint, Info, Indexes
item_5 = ListItem(List=pt, Index=rdpoints.Indexes, Wrap=True)
cp = ClosestPoint(Point=item_5, Cloud=pt)  # -> ClosestPoint, simplify(graft(CPIndex)), Distance
merge_2 = Merge(Data1=simplify(graft(rdpoints.Indexes)), Data2=cp.CPIndex)
item_6 = ListItem(List=vec_pt_force_3, Index=merge_2, Wrap=True)
item_7 = ListItem(List=pt, Index=merge_2, Wrap=True)
ma = MassAddition(Input=item_6)  # -> Result, PartialResults
item_8 = ListItem(List=item_7, Index=0, Wrap=True)
vdisex = VectorDisplayEx(Point=item_8, Vector=ma.Result, Colour=RGB(0, 0, 0), Width=Slider(3, range=0..10))

# ----
pline = PolyLine(Vertices=move.Geometry, Closed=False)  # disabled
curve = Curve(pline)  # disabled
pt_intersection_nodes_3 = ClusterOutput(pt_intersection_nodes_2)
vec_pt_force_4 = ClusterOutput(vec_pt_force_2)

# ==== cluster EmbedCables
segments = ClusterInput()
cables = ClusterInput()
segments_2 = Surface(simplify(segments))
cables_2 = Curve(cables)
surface_curve = SurfaceCurve(Surface=segments_2, Curve=flatten(cables_2))  # -> simplify(Curves), Points, UVPoints, Normals, Parameters, Tangents
trim = TrimTree(Tree=surface_curve.Curves, Depth=1)
srfsplit = SurfaceSplit(Surface=segments_2, Curves=trim)
trim_2 = TrimTree(Tree=srfsplit, Depth=1)
split_segments = Geometry(trim_2)
split_cables = Geometry(trim)
split_segments_2 = ClusterOutput(split_segments)
split_cables_2 = ClusterOutput(split_cables)

# ==== cluster Karamba
springs = ClusterInput()
mesh = ClusterInput()
springs_2 = Line(springs)
mesh_2 = Mesh(mesh)
number_slider = Slider(3, range=0..10)

panel = Panel("main direction")
_10º = PowerOf10(Value=Slider(-4, range=-6..10))
multiplication = Multiplication(A=Slider(1, range=1..10), B=_10º)

mesh_3 = Mesh(mesh_2)
mjoin = MeshJoin(Meshes=mesh_3)
_10º_2 = PowerOf10(Value=Slider(5, range=0..10))
_10º_3 = PowerOf10(Value=number_slider)
_10º_4 = PowerOf10(Value=Slider(5, range=0..10))
_10º_5 = PowerOf10(Value=Slider(2, range=0..10))
_10º_6 = PowerOf10(Value=Slider(5, range=0..10))
_10º_7 = PowerOf10(Value=Slider(1, range=0..10))
_10º_8 = PowerOf10(Value=Slider(5, range=0..10))
multiplication_2 = Multiplication(A=Slider(1, range=0..1), B=_10º_4)
multiplication_3 = Multiplication(A=Slider(1, range=0..1), B=_10º_2)
multiplication_4 = Multiplication(A=Slider(1, range=0..1), B=_10º_6)
multiplication_5 = Multiplication(A=Slider(1, range=0..1), B=_10º_7)
multiplication_6 = Multiplication(A=Slider(1, range=0..1), B=_10º_5)
multiplication_7 = Multiplication(A=Slider(1, range=1..10), B=_10º_3)
multiplication_8 = Multiplication(A=Slider(1, range=0..1), B=_10º_8)
vec = VectorXYZ(XComponent=multiplication_2, YComponent=multiplication_4, ZComponent=multiplication_3)  # -> Vector, Length
# spring setup
vec_2 = VectorXYZ(XComponent=multiplication_7, YComponent=multiplication_7, ZComponent=multiplication_7)  # -> Vector, Length
vec_3 = VectorXYZ(XComponent=multiplication_5, YComponent=multiplication, ZComponent=multiplication_6)  # -> Vector, Length
vec_4 = VectorXYZ(XComponent=multiplication_8, YComponent=multiplication_8, ZComponent=multiplication_8)  # -> Vector, Length
cross_section = CrossSectionKaramba3D(
    FamilyNameOfCrossSection="DefaultCroSec",
    ElementIdentifier="spring",
    CTranslation_kN_m=vec.Vector,
    CRotation_kNm_rad=vec_3.Vector,
    mode="Spring")
merge = Merge(Data2=cross_section)
crosec = CrossSectionKaramba(merge)
number_slider_2 = Slider(9.862, range=0..10)  # "kN/m2"
number_slider_3 = Slider(6.44, range=0..100)
Z = UnitZ(Factor=Slider(10, range=0..10))
rev = Reverse(Vector=Z)
cross_section_2 = CrossSectionKaramba3D(
    FamilyNameOfCrossSection="DefaultCroSec",
    Material=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,
    Height_cm=Slider(5, range=0..10),
    mode="Shell - Const")
loads = LoadsKaramba3D(Vector=rev, Mesh=mesh_2, mode="MeshLoad -Const.", menu=[buttons(off, on, off), buttons(on, on)])
bottompoints = BottomPoints(mesh=mesh_2, ltol=Slider(2, range=0..10))  # -> flatten(pt_3)
supp = SupportKaramba3D(PosInd=bottompoints, menu=[buttons(on, on, on, off, off, on)])
linetobeam = LineToBeamKaramba(Line=flatten(springs_2), Identifier="spring", New=True, Remove=True, LimitDistance_m=0.005)  # -> simplify(Element), Points, Info
loads_2 = LoadsKaramba3D(Vector=Vector(0, 0, -1), mode="Gravity")
matselect = MaterialSelectionKaramba3D(menu=[dropdown(3), dropdown(1)])
panel_2 = Panel(loads)
meshtoshell = MeshToShellKaramba3D(Mesh=mesh_2, LimitDistance_m=0.005)  # -> Element, flatten(Points), Info
merge_2 = Merge(Data1=flatten(linetobeam.Element), Data2=flatten(meshtoshell.Element))
element = ElementKaramba(merge_2)
pt = Point(meshtoshell.Points)
mag_ct = Integer(number_slider)
rec = DataRecorder(mag_ct, DataLimit=-10, RecordData=False)
quick_graphs = QuickGraphs()

# ---- group: live load patterns
mesh_4 = Mesh(simplify(graft(mesh_3)))
image = ImageSampler(Filter="Colour", Interpolate=False, Umax=1, Umin=0, Vmax=1, Vmin=0, Wrap=1)
load_pattern = Slider(7, range=1..7)
bbox = BoundingBox(Content=flatten(mesh_4), Plane=PlaneXY(0, 0, 0), UnionBox=True)  # -> Box, Box_2
faceb = FaceBoundaries(Mesh=mesh_4)  # -> simplify(Boundaries)
box = EvaluateBox(Box=bbox.Box, UParameter=0.5, VParameter=0.5, WParameter="1")  # -> Plane, simplify(Point), Include
pattern_domains = PatternDomains(G=load_pattern)
area = Area(Geometry=faceb)  # -> Area, Centroid
pt_2 = Point(simplify(graft(area.Centroid)))
sph = Sphere(Base=box.Plane, Radius=Slider(2, range=0..10))
polar = ToPolar(Point=pt_2, System=box.Plane)  # -> simplify(Phi), Theta, Radius
wh_value_for_live_load = Panel("3.5")
pt_3 = Point(simplify(area.Centroid))

# ----
data = Data(flatten(pattern_domains))
face_area_m2 = Number(area.Area)
mesh_5 = Mesh(mesh_4)

# ---- group: live load patterns (continued)
dom² = ConstructDomain²(DomainU=data, DomainV="0 To Pi")
subsrf = Isotrim(Surface=sph, Domain=dom²)
inc = Includes(Value=polar.Phi, Domain=data)  # -> Includes, Deviation
ma = MassAddition(Input=inc.Includes)  # -> Result, PartialResults
bool = Boolean(ma.Result)
multiplication_9 = Multiplication(A=number_slider_2, C=bool)
dispatch = Dispatch(List=pt_2, DispatchPattern=bool)  # -> ListA, ListB
live_load_kn_m2_per_face = Number(multiplication_9)
outside = Point(dispatch.ListB)
inside = Point(dispatch.ListA)
Z_2 = UnitZ(Factor=live_load_kn_m2_per_face)
rev_2 = Reverse(Vector=Z_2)

# ----
multiplication_10 = Multiplication(A=live_load_kn_m2_per_face, B=face_area_m2)  # disabled
trim = TrimTree(Tree=rev_2, Depth=1)

# ---- group: live load patterns (continued)
vdis = VectorDisplay(Anchor=pt_3, Vector=trim)
loads_3 = LoadsKaramba3D(Vectors=trim, Mesh=mesh_5, mode="MeshLoad -Variable", menu=[buttons(off, on, off), buttons(on, on)])

# ----
load = LoadKaramba3D(flatten(loads_3))
panel_3 = Panel(load)

# ----
# Karamba analysis
# and results
assemble = AssembleModelKaramba3D(Point=pt, Elem=element, Support=supp, Load=load, CrossSection=crosec, Material=matselect, LimitDistance_m=0.005)  # -> Model, Info, Mass_kg, CenterOfGravity
analyze = AnalyzeKaramba3D(Model=assemble.Model)  # -> CalculatedModel, MaximumDisplacement_cm, ResultingForceOfGravity_kN, ElasticEnergy_kNm
modelview = ModelViewKaramba3D(Model=analyze.CalculatedModel, ResultFactors=1, ResultCase=-1)  # -> Model, DeformedMesh, DeformedAxes, DeformedModel
medges = MeshEdges(Mesh=modelview.DeformedMesh)  # -> NakedEdges, InteriorEdges, NonManifoldEdges
crv = Curve(medges.NakedEdges)

analyzethii = AnalyzeThIIKaramba3D(Model=assemble.Model, RTolerance=1e-07, MaxIterations=50, NoTensionalNII=False)  # -> CalculatedModel, MaximumDisplacement_cm, ResultingForceOfGravity_kN, ElasticEnergy_kNm; disabled
bmodes = BucklingModesKaramba3D(
    Model=analyzethii.CalculatedModel,
    FromIndex=1,
    NumberOfModes=Slider(3, range=0..10),
    MaximumNumberOfIterations=300,
    Epsilon=1e-07)  # -> ModelWithBucklingModesAsLoadCaseResults, BucklingLoadFactors
beamview = BeamViewKaramba3D(Model=modelview.Model)  # -> Model, MeshesOfRenderedBeams, DeformedBeamAxes, LegendColors, LegendTags; disabled
model = ModelKaramba3D(modelview.Model)
panel_4 = Panel(bmodes.BucklingLoadFactors)
shellview = ShellViewKaramba3D(Model=modelview.Model, IndexOfLayer=0)  # -> Model, MeshesOfRenderedShells, LegendColors, LegendTags
crv_2 = Curve(modelview.DeformedAxes)
explode = Explode(Curve=simplify(crv_2), Recursive=True)  # -> Segments, Vertices
mesh_6 = Mesh(modelview.DeformedMesh)
legend = Legend(Colour=shellview.LegendColors, Tags=shellview.LegendTags, LegendType=1)
item = ListItem(List=explode.Segments, Index=Slider(0, range=0..1), Wrap=True)
item_2 = ListItem(List=reverse(shellview.LegendTags), Index=0, Wrap=True)  # -> Item, Item1
item_3 = ListItem(List=shellview.LegendTags, Index=0, Wrap=True)  # -> Item, Item1
panel_5 = Panel(item_3.Item1)
panel_6 = Panel(item_2.Item1)
max_stress_comp = Number(item_3.Item1)
max_stress_tens = Number(item_2.Item1)
max_disp = Number(analyze.MaximumDisplacement_cm)
rec_2 = DataRecorder(max_stress_tens, DataLimit=-10, RecordData=False)
rec_3 = DataRecorder(max_stress_comp, DataLimit=-10, RecordData=False)
rec_4 = DataRecorder(max_disp, DataLimit=-10, RecordData=False)

# ==== cluster MeshSegments
offset_segments = ClusterInput()
mesh_resolution = ClusterInput()
mesh_resolution_2 = Number(mesh_resolution)
offset_segments_2 = Surface(simplify(offset_segments))
# IPts not working on trimmed surface
number_slider = Slider(3, range=0..10)
smooth = SettingsQuality()
mesh_breps = MeshBrepsKaramba3D(
    Brep=offset_segments_2,
    MeshResolution=mesh_resolution_2,
    EdgeRefinementFactor=0.67,
    PointReduction=False,
    SmoothingStepSize=Slider(1, range=0..1),
    SmoothingIterations=number_slider)  # -> simplify(Mesh), Info
custom_mesh_settings = SettingsCustom(
    StitchSeams=True,
    SimplePlanes=False,
    Refine=True,
    MinCount=16,
    MaxCount=400,
    AspectRatio=20,
    MaxDistance=0,
    MaxAngle=20,
    MinEdge=0,
    MaxEdge=0)
medges = MeshEdges(Mesh=mesh_breps.Mesh)  # -> NakedEdges, InteriorEdges, NonManifoldEdges
mesh = MeshBrep(Brep=offset_segments_2, Settings=custom_mesh_settings)
mjoin = MeshJoin(Meshes=mesh_breps.Mesh)
panel = Panel(offset_segments_2)
crv = Curve(medges.NakedEdges)
mesh_2 = Mesh(mjoin)
mesh_3 = ClusterOutput(mesh_2)

# ==== cluster WIPAlternativeOffsetMeshing
segments = ClusterInput()

# ---- group: determine internal edges + topology
segments_2 = Surface(segments)
join = BrepJoin(Breps=segments_2)  # -> Breps, Closed
debrep = DeconstructBrep(Brep=join.Breps)  # -> Faces, Edges, Vertices
topology = BrepTopology(Brep=join.Breps, PerspectiveOnly=False)  # -> FaceFaceAdjacency, simplify(FaceEdgeAdjacency), simplify(EdgeFaceAdjacency)
lng = ListLength(List=topology.EdgeFaceAdjacency)
larger = LargerThan(FirstNumber=lng, SecondNumber="1")  # -> LargerThan, OrEqualTo
dispatch = Dispatch(List=topology.EdgeFaceAdjacency, DispatchPattern=larger.LargerThan)  # -> ListA, ListB
clean = CleanTree(RemoveNulls=True, RemoveInvalid=True, RemoveEmpty=Toggle(True), Tree=dispatch.ListA)
tstat = TreeStatistics(Tree=clean)  # -> Paths, Length, Count
dpath = DeconstructPath(Branch=tstat.Paths)
item = ListItem(List=debrep.Edges, Index=flatten(dpath), Wrap=True)
match = MatchTree(Tree=graft(item), Guide=clean)
adjacent_faces = Integer(clean)
internal_edges = Curve(match)

# ----
offset_segments = ClusterInput()
number_slider = Slider(18, range=0..100)
offset_segments_2 = Surface(simplify(offset_segments))
debrep_2 = DeconstructBrep(Brep=offset_segments_2)  # -> Faces, Edges, Vertices
item_2 = ListItem(List=debrep.Edges, Index=number_slider, Wrap=True)
divint = DivInt(crv=debrep_2.Edges, num=Slider(0.322, range=0..1))  # -> pts_2, midpts_2
branch = TreeBranch(Tree=internal_edges, Path=number_slider, MaintainPaths=True)
int = Integer(simplify(graft(topology.FaceEdgeAdjacency)))
number_slider_2 = Slider(5, range=0..10)
divint_2 = DivInt(crv=debrep.Edges, num=Slider(0.322, range=0..1))  # -> pts_2, midpts_2
debrep_3 = DeconstructBrep(Brep=offset_segments_2)  # -> Faces, Edges, Vertices
nullrep = ReplaceNulls(Items=divint_2.pts_2)  # -> Items, Count
join_2 = JoinCurves(Curves=debrep_3.Edges, Preserve=False)  # -> simplify(Curves)
group = Group(Objects=divint_2.pts_2)
branch_2 = TreeBranch(Tree=offset_segments_2, Path=number_slider_2, MaintainPaths=True)
item_3 = ListItem(List=flatten(group), Index=int, Wrap=True)
ungroup = Ungroup(Group=item_3)  # -> simplify(Objects)
panel = Panel(int)
trim = TrimTree(Tree=ungroup, Depth=1)
branch_3 = TreeBranch(Tree=trim, Path=number_slider_2, MaintainPaths=True)
crv_cp = CurveClosestPoint(Point=trim, Curve=join_2)  # -> Point, Parameter, Distance
srf_cp = SurfaceClosestPoint(Point=trim, Surface=offset_segments_2)  # -> Point, UVPoint, Distance

# ==== cluster Make2DGraph
current_solution = ClusterInput()
selected_parameter_x_axis = ClusterInput()
graph_origin = ClusterInput()
selected_result_y_axis = ClusterInput()
parameter_labels = ClusterInput()
design_space_vectors = ClusterInput()
all_results = ClusterInput()
result_labels = ClusterInput()
reference_values = ClusterInput()
selected_parameter_x_axis_2 = Integer(selected_parameter_x_axis)
current_solution_2 = Data(current_solution)
graph_origin_2 = Point(graph_origin)
selected_result_y_axis_2 = Integer(selected_result_y_axis)
parameter_labels_2 = Text(parameter_labels)
design_space_vectors_2 = Data(design_space_vectors)
all_results_2 = Number(all_results)
result_labels_2 = Text(result_labels)
reference_values_2 = Text(reference_values)
item = ListItem(List=reference_values_2, Index=selected_result_y_axis_2, Wrap=True)
item_2 = ListItem(List=result_labels_2, Index=selected_result_y_axis_2, Wrap=True)
item_3 = ListItem(List=parameter_labels_2, Index=selected_parameter_x_axis_2, Wrap=True)
params = Number(simplify(graft(current_solution_2)))
closest_solution = ClosestSolution(params_current_solution=params, ds_coords=design_space_vectors_2)  # -> index_curr_vector_2, design_vector_2
panel = Panel(current_solution_2)
section_ds = SectionDS(design_vector=closest_solution.design_vector_2, design_space=design_space_vectors_2, dims=selected_parameter_x_axis_2)
tstat = TreeStatistics(Tree=section_ds)  # -> Paths, Length, Count
branch = TreeBranch(Tree=all_results_2, Path=tstat.Paths, MaintainPaths=True)
panel_2 = Panel(section_ds)
transform_points_to_landscape = TransformPointsToLandscape(
    dim_labels=parameter_labels_2,
    dimensons_for_variation=selected_parameter_x_axis_2,
    sectioned_data=section_ds,
    results=all_results_2,
    result_label=item_2,
    result_int=selected_result_y_axis_2)  # -> fixed_2, labels_2, transformed_points_2
panel_3 = Panel(branch)
int_curr_solution = Integer(closest_solution.index_curr_vector_2)
number_slider = Slider(0.5, range=0..1)
number_slider_2 = Slider(6, range=0..20)
panel_4 = Panel("2.5")
selected_parameter = Text(item_3)
reference_value = Text(item)
selected_result = Text(item_2)
_2d_graph = _2DGraph(
    labels=transform_points_to_landscape.labels_2,
    fixed=transform_points_to_landscape.fixed_2,
    graph_origin=graph_origin_2,
    ref_value=item,
    original_points=transform_points_to_landscape.transformed_points_2,
    target_grid_line=Slider(10, range=0..30))  # -> mesh_2, transformed_points_2
pt = Point(transform_points_to_landscape.transformed_points_2)
concat = Concatenate(FragmentA="selected parameter (X axis): ", FragmentB=selected_parameter)
concat_2 = Concatenate(FragmentA="selected result (Y axis): ", FragmentB=selected_result)
concat_3 = Concatenate(FragmentA="result reference value: ", FragmentB=reference_value)
merge = Merge(Data1=concat, Data2=concat_2, Data3=concat_3)
pt_2 = Point(_2d_graph.transformed_points_2)
min_point = MinPoint(transformed_points=_2d_graph.transformed_points_2)  # -> min_point_2, min_id_2
curr_point = CurrPoint(transformed_points=_2d_graph.transformed_points_2, int_curr_solution=int_curr_solution)
panel_5 = Panel(merge)
out = Text(merge)
panel_6 = Panel("C:\Users\ec977\Documents\_Rhino Frames\20200602-SIMPLEcull20\Frame_00")
vector_value = VectorValue(curr_point=curr_point, original_points=pt, int_curr_solution=int_curr_solution, above=Toggle(False))
curr_thumbnail = CurrThumbnail(folder_file=panel_6, curr_point=curr_point, int_curr_solution=int_curr_solution)
min_value = MinValue(curr_point=min_point.min_point_2, original_points=pt, int_curr_solution=min_point.min_id_2)
out_2 = ClusterOutput(out)

# ==== cluster MultiPatchGH
shell_plan = ClusterInput()
bay_geometry = ClusterInput()
shell_plan_2 = Curve(shell_plan)
bay_geometry_2 = Geometry(bay_geometry)
explode = Explode(Curve=bay_geometry_2, Recursive=True)  # -> graft(Segments), Vertices
intcrv = Interpolate(Vertices=explode.Vertices, Degree=3, Periodic=Toggle(True), KnotStyle=1)  # -> Curve, Length, Domain
boundary = BoundarySurfaces(Edges=intcrv.Curve)
area = Area(Geometry=intcrv.Curve)  # -> Area, Centroid
extr = ExtrudePoint(Base=flatten(intcrv.Curve), Point=area.Centroid)
srf_cp = SurfaceClosestPoint(Point=explode.Vertices, Surface=reparameterize(extr))  # -> Point, UVPoint, Distance
pdecon = Deconstruct(Point=srf_cp.UVPoint)  # -> XComponent, YComponent, ZComponent
cull_i = CullIndex(List=pdecon.YComponent, Indices="0", Wrap=True)
cull_i_2 = CullIndex(List=cull_i, Indices="-1", Wrap=True)
merge = Merge(Data1=flatten("0"), Data2=flatten(cull_i_2), Data3=flatten("1"))
consec = ConsecutiveDomains(Numbers=merge, Additive=False)
dom = ConstructDomain(DomainStart=0, DomainEnd=1)
panel = Panel(consec)
dom² = ConstructDomain²(DomainU=dom, DomainV=consec)
divide = DivideDomain²(Domain=extr, UCount=Slider(1, range=0..10), VCount=Slider(10, range=0..10))
subsrf = Isotrim(Surface=reparameterize(extr), Domain=dom²)  # -> simplify(graft(Surface))
srfsplit = SurfaceSplit(Surface=subsrf, Curves=shell_plan_2)  # -> simplify(Fragments)
area_2 = Area(Geometry=srfsplit)  # -> Area, Centroid
sort = SortList(Keys=area_2.Area, ValuesA=srfsplit)  # -> Keys, ValuesA
item = ListItem(List=reverse(sort.ValuesA), Index=0, Wrap=True)  # -> flatten(Item)

# ---- group: isolines
number_slider = Slider(8, range=0..10)
number_slider_2 = Slider(9, range=0..10)
number_slider_3 = Slider(7, range=0..10)
one_over_x = OneOverX(Value=number_slider)
one_over_x_2 = OneOverX(Value=number_slider_2)
one_over_x_3 = OneOverX(Value=number_slider_3)
recgrid = Rectangular(Plane=PlaneXY(0, 0, 0), SizeX=one_over_x_3, SizeY=one_over_x_2, ExtentX=number_slider_3, ExtentY=number_slider_2)  # -> Cells, Points
sqgrid = Square(Plane=PlaneXY(0, 0, 0), Size=one_over_x, ExtentX=number_slider, ExtentY=number_slider)  # -> Cells, graft(Points)
iso = IsoCurve(Surface=reparameterize(item), UVPoint=sqgrid.Points)  # -> UIsocurve, VIsocurve

# ----
md_slider = MDSlider(
    SliderMode=0,
    slider_value=Point(0.8889428115, 0.7862578601, 0.5),
    x_domain=Domain(0, 1),
    y_domain=Domain(0, 1),
    z_domain=Domain(0, 1))
evalsrf = EvaluateSurface(Surface=reparameterize(item), Point=md_slider)  # -> Point, Normal, UDirection, VDirection, Frame
join = BrepJoin(Breps=item)  # -> Breps, Closed
_4_piece = Surface(item)

int = Integer(Slider(18, range=0..100))
one_over_x_4 = OneOverX(Value=int)
sqgrid_2 = Square(Plane=PlaneXY(0, 0, 0), Size=one_over_x_4, ExtentX=int, ExtentY=int)  # -> Cells, Points
iso_2 = IsoCurve(Surface=reparameterize(_4_piece), UVPoint=simplify(graft(sqgrid_2.Points)))  # -> UIsocurve, VIsocurve

_4_piece_2 = ClusterOutput(_4_piece)

# ==== cluster IntersectStressLines
stress_lines = ClusterInput()
stress_lines_2 = Curve(stress_lines)
bang = ExplodeTree(Data=stress_lines_2)  # -> Branch0, Branch1
edge_cables = Curve(bang.Branch1)
corner_cables = Curve(bang.Branch0)
crossref = CrossReference(ListA=corner_cables, ListB=edge_cables, CrossMode=1)  # -> ListA, ListB
ccx = CurveCurve(CurveA=crossref.ListA, CurveB=crossref.ListB)  # -> Points, ParamsA, ParamsB
intersection_points = Point(ccx.Points)
intersection_points_2 = ClusterOutput(intersection_points)

# ==== cluster JigglePoints
maximum_deviation = ClusterInput()
intersection_points = ClusterInput()
curves_to_snap = ClusterInput()
rho_values = ClusterInput()
phi_values = ClusterInput()
intersection_points_2 = Point(flatten(intersection_points))
curves_to_snap_2 = Curve(curves_to_snap)
phi_values_2 = Number(phi_values)
maximum_deviation_2 = Number(maximum_deviation)
rho_values_2 = Number(rho_values)
pt = Point(simplify(graft(intersection_points_2)))
lot = Integer(Slider(2, range=0..10))
neg = Negative(Value=lot)
crv_cp = CurveClosestPoint(Point=pt, Curve=curves_to_snap_2)  # -> Point, Parameter, Distance
_10º = PowerOf10(Value=neg)
smaller = SmallerThan(FirstNumber=crv_cp.Distance, SecondNumber=_10º)  # -> SmallerThan, OrEqualTo
pt_2 = Point(pt)
dispatch = Dispatch(List=pt, DispatchPattern=smaller.SmallerThan)  # -> simplify(ListA), simplify(ListB)
bbox = BoundingBox(Content=flatten(pt_2), Plane=PlaneXY(0, 0, 0), UnionBox=True)  # -> Box, Box_2
edges = BrepEdges(Brep=bbox.Box)  # -> Naked, Interior, NonManifold
pt_on_curve = Point(dispatch.ListA)
pt_off_curve = Point(dispatch.ListB)
end = EndPoints(Curve=edges.Naked)  # -> Start, End
phi = Number(graft(phi_values_2))
toggle = BooleanToggle(False)
cp = ClosestPoint(Point=pt_2, Cloud=end.Start)  # -> ClosestPoint, CPIndex, Distance
max_phi = Slider(1, range=1..2)
round = Round(Number=phi)  # -> Nearest, Floor, Ceiling
Z = UnitZ(Factor=1)
vec2pt = Vector2Pt(PointA=pt_2, PointB=cp.ClosestPoint, Unitize=toggle)  # -> Vector, Length
cir = Circle(Plane=pt, Radius=maximum_deviation_2)
crossref = CrossReference(ListA=pt_off_curve, ListB=round.Nearest, CrossMode=3)  # -> ListA, ListB
crossref_2 = CrossReference(ListA=pt_on_curve, ListB=phi, CrossMode=3)  # -> ListA, ListB
radius = Number(graft(rho_values_2))
xprod = CrossProduct(VectorA=vec2pt.Vector, VectorB=Z, Unitize=toggle)  # -> Vector, Length
merge = Merge(Data1=crossref_2.ListB, Data2=crossref.ListB)
pi = Pi(Factor=max_phi)
pl = ConstructPlane(Origin=pt_2, XAxis=vec2pt.Vector, YAxis=xprod.Vector)
remap = RemapNumbers(Value=merge, Source=Domain(0, 1), Target=pi)  # -> Mapped, Clipped
remap_2 = RemapNumbers(Value=radius, Source=Domain(0, 1), Target=maximum_deviation_2)  # -> Mapped, Clipped
deviation_spaces = Curve(cir)
pt_3 = PointPolar(BasePlane=pl, XYAngle=remap.Mapped, ZAngle=0, Offset=remap_2.Mapped)
jiggled_points = Point(pt_3)
jiggled_points_2 = ClusterOutput(jiggled_points)

# ==== cluster MakeSegments
tolerance = ClusterInput()
stress_lines = ClusterInput()
tolerance_2 = Number(tolerance)
stress_lines_2 = Curve(stress_lines)
bang = ExplodeTree(Data=stress_lines_2)  # -> Branch0, Branch1
intersection_points = ClusterInput()
lot = Integer(Slider(0, range=0..10))
neg = Negative(Value=lot)
intersection_points_2 = Point(flatten(intersection_points))
corner_lines = Curve(bang.Branch0)
edge_lines = Curve(bang.Branch1)
_10º = PowerOf10(Value=neg)
# tolerance same as max deviation because maxDev is being set do that circles do not intersect - needs improvement
tolerance_3 = Number(tolerance_2)
crv_cp = CurveClosestPoint(Point=intersection_points_2, Curve=graft(corner_lines))  # -> Point, Parameter, Distance
crv_cp_2 = CurveClosestPoint(Point=intersection_points_2, Curve=graft(edge_lines))  # -> Point, Parameter, Distance
smaller = SmallerThan(FirstNumber=crv_cp.Distance, SecondNumber=tolerance_3)  # -> SmallerThan, OrEqualTo
smaller_2 = SmallerThan(FirstNumber=crv_cp_2.Distance, SecondNumber=tolerance_3)  # -> SmallerThan, OrEqualTo
dispatch = Dispatch(List=intersection_points_2, DispatchPattern=smaller_2.SmallerThan)  # -> ListA, ListB
dispatch_2 = Dispatch(List=intersection_points_2, DispatchPattern=simplify(smaller.SmallerThan))  # -> ListA, ListB
pt_on_curve = Point(simplify(dispatch_2.ListA))
pt_on_curve_2 = Point(simplify(dispatch.ListA))
alongcrv = SortAlongCurve(Points=pt_on_curve, Curve=simplify(graft(corner_lines)))  # -> simplify(Points), Indices
alongcrv_2 = SortAlongCurve(Points=pt_on_curve_2, Curve=simplify(graft(edge_lines)))  # -> simplify(Points), Indices
pline = PolyLine(Vertices=alongcrv.Points, Closed=False)
pline_2 = PolyLine(Vertices=alongcrv_2.Points, Closed=False)
entwine = Entwine(Branch00=pline, Branch01=pline_2, FlattenInputs=True)  # -> simplify(Result)
segment_plans = Curve(entwine)
segment_plans_2 = ClusterOutput(segment_plans)

# ==== cluster MakeKeystone
surface_plan = ClusterInput()
intersection_points = ClusterInput()
surface_plan_2 = Curve(surface_plan)
intersection_points_2 = Point(intersection_points)
explode = Explode(Curve=surface_plan_2, Recursive=True)  # -> Segments, Vertices
lng = ListLength(List=explode.Segments)
division = Division(A=lng, B=2)
area = Area(Geometry=surface_plan_2)  # -> Area, Centroid
center = Point(area.Centroid)
cps = ClosestPoints(Point=center, Cloud=flatten(intersection_points_2), Count=division)  # -> ClosestPoint, CPIndex, Distance
cir = Circle(Plane=center, Radius=1)
alongcrv = SortAlongCurve(Points=cps.ClosestPoint, Curve=cir)  # -> Points, Indices
pline = PolyLine(Vertices=alongcrv.Points, Closed=Toggle(True))
keystone_plan = Curve(pline)
keystone_plan_2 = ClusterOutput(keystone_plan)

# ==== cluster BoxSize
box = ClusterInput()
box_2 = Box(box)
debox = DeconstructBox(Box=box_2)  # -> Plane, X, Y, Z
dedomain = DeconstructDomain(Domain=debox.X)  # -> Start, End
dedomain_2 = DeconstructDomain(Domain=debox.Y)  # -> Start, End
dedomain_3 = DeconstructDomain(Domain=debox.Z)  # -> Start, End
subtraction = Subtraction(A=dedomain_2.End, B=dedomain_2.Start)
subtraction_2 = Subtraction(A=dedomain.End, B=dedomain.Start)
subtraction_3 = Subtraction(A=dedomain_3.End, B=dedomain_3.Start)
Y = Number(subtraction)
X = Number(subtraction_2)
Z = Number(subtraction_3)
multiplication = Multiplication(A=X, B=Y)
multiplication_2 = Multiplication(A=multiplication, B=Z)
V = Number(multiplication_2)
A = Number(multiplication)
Y_2 = ClusterOutput(Y)
X_2 = ClusterOutput(X)
Z_2 = ClusterOutput(Z)
V_2 = ClusterOutput(V)
A_2 = ClusterOutput(A)

# ==== cluster TestSurface
number_slider = Slider(3, range=0..10)
srf = Surface(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)
scale_nu = ScaleNU(Geometry=srf, Plane=PlaneXY(0, 0, 0), ScaleX=1, ScaleY=1, ScaleZ=Slider(1.042, range=0..5))  # -> Geometry, Transform
panel = Panel("1")
srf_2 = Surface(scale_nu.Geometry)
divide = DivideDomain²(Domain=srf_2, UCount=number_slider, VCount=number_slider)
subsrf = Isotrim(Surface=reparameterize(srf_2), Domain=divide)
S = ClusterOutput(subsrf)

# ==== cluster SpringAngles
crv = ClusterInput()
crv_2 = Curve(crv)
end = EndPoints(Curve=crv_2)  # -> Start, End
xy = XYPlane(Origin=end.Start)
project = Project(Geometry=crv_2, Plane=xy)  # -> Geometry, Transform
end_2 = EndPoints(Curve=project.Geometry)  # -> Start, End
vec2pt = Vector2Pt(PointA=end_2.Start, PointB=end_2.End, Unitize=False)  # -> Vector, Length
vec2pt_2 = Vector2Pt(PointA=end.Start, PointB=end.End, Unitize=False)  # -> Vector, Length
angle = Angle(VectorA=vec2pt_2.Vector, VectorB=vec2pt.Vector)  # -> Angle, Reflex
deg = Degrees(Radians=angle.Angle)
panel = Panel(deg)
sort = SortList(Keys=flatten(deg))  # -> Keys, ValuesA
bnd = Bounds(Numbers=sort.Keys)
panel_2 = Panel(bnd)

# ==== cluster BottomPoints
ltol = ClusterInput()
mesh = ClusterInput()
mesh_2 = Mesh(mesh)
ltol_2 = Integer(ltol)
demesh = DeconstructMesh(Mesh=mesh_2)  # -> Vertices, Faces, Colours, Normals
pt = Point(flatten(demesh.Vertices))
bbox = BoundingBox(Content=pt, Plane=PlaneXY(0, 0, 0), UnionBox=True)  # -> Box, Box_2
box = EvaluateBox(Box=bbox.Box, UParameter="0", VParameter="0", WParameter="0")  # -> Plane, Point, Include
neg = Negative(Value=ltol_2)
_10º = PowerOf10(Value=neg)
cp = PlaneClosestPoint(Point=pt, Plane=box.Plane)  # -> Point, UVPoint, Distance
panel = Panel("1e-10")
smaller = SmallerThan(FirstNumber=cp.Distance, SecondNumber=_10º)  # -> SmallerThan, OrEqualTo
boxdims = BoxDims(box=bbox.Box)  # -> dx_2, dy_2, dz_2
dispatch = Dispatch(List=pt, DispatchPattern=smaller.SmallerThan)  # -> ListA, ListB
duppt = RemoveDuplicatePts(Points=dispatch.ListA, Tolerance=0.01)  # -> simplify(UniquePoints)
division = Division(A=boxdims.dx_2, B="2")
pgroups = PointGroups(Points=duppt, Distance=division)  # -> simplify(Groups), Indices
pt_2 = Point(pgroups.Groups)
pt_3 = ClusterOutput(pt_2)

# ==== cluster PatternDomains

# ---- group: pattern 5
number_slider = Slider(0, range=0..10)
number_slider_2 = Slider(2, range=0..10)
addition = Addition(A=number_slider, B="2")
series = Series(Start=addition, Step="4", Count=number_slider_2)
series_2 = Series(Start=number_slider, Step="4", Count=number_slider_2)
multiplication = Multiplication(A=series_2, B=".25")
multiplication_2 = Multiplication(A=series, B=".25")
pi = Pi(Factor=multiplication_2)
pi_2 = Pi(Factor=multiplication)
panel = Panel(pi_2)
panel_2 = Panel(pi)
dom = ConstructDomain(DomainStart=panel, DomainEnd=panel_2)  # -> graft(Domain)

# ---- group: pattern 6
number_slider_3 = Slider(0, range=0..10)
number_slider_4 = Slider(4, range=0..10)
addition_2 = Addition(A=number_slider_3, B="1")
series_3 = Series(Start=addition_2, Step="2", Count=number_slider_4)
series_4 = Series(Start=number_slider_3, Step="2", Count=number_slider_4)
multiplication_3 = Multiplication(A=series_4, B=".25")
multiplication_4 = Multiplication(A=series_3, B=".25")
pi_3 = Pi(Factor=multiplication_4)
pi_4 = Pi(Factor=multiplication_3)
panel_3 = Panel(pi_4)
panel_4 = Panel(pi_3)
dom_2 = ConstructDomain(DomainStart=panel_3, DomainEnd=panel_4)  # -> graft(Domain)

# ---- group: pattern 4
number_slider_5 = Slider(1, range=0..10)
number_slider_6 = Slider(2, range=0..10)
addition_3 = Addition(A=number_slider_5, B="2")
series_5 = Series(Start=addition_3, Step="4", Count=number_slider_6)
series_6 = Series(Start=number_slider_5, Step="4", Count=number_slider_6)
multiplication_5 = Multiplication(A=series_6, B=".25")
multiplication_6 = Multiplication(A=series_5, B=".25")
pi_5 = Pi(Factor=multiplication_6)
pi_6 = Pi(Factor=multiplication_5)
panel_5 = Panel(pi_6)
panel_6 = Panel(pi_5)
dom_3 = ConstructDomain(DomainStart=panel_5, DomainEnd=panel_6)  # -> graft(Domain)

# ---- group: pattern 1
multiplication_7 = Multiplication(A=Slider(0, range=0..10), B=".25")
multiplication_8 = Multiplication(A=Slider(0, range=0..10), B=".25")
pi_7 = Pi(Factor=multiplication_7)
pi_8 = Pi(Factor=multiplication_8)
panel_7 = Panel(pi_7)
panel_8 = Panel(pi_8)
dom_4 = ConstructDomain(DomainStart=panel_7, DomainEnd=panel_8)

# ---- group: pattern 2
multiplication_9 = Multiplication(A=Slider(2, range=0..10), B=".25")
multiplication_10 = Multiplication(A=Slider(6, range=0..10), B=".25")
pi_9 = Pi(Factor=multiplication_9)
pi_10 = Pi(Factor=multiplication_10)
panel_9 = Panel(pi_9)
panel_10 = Panel(pi_10)
dom_5 = ConstructDomain(DomainStart=panel_9, DomainEnd=panel_10)

# ---- group: pattern 3
multiplication_11 = Multiplication(A=Slider(1, range=0..10), B=".25")
multiplication_12 = Multiplication(A=Slider(5, range=0..10), B=".25")
pi_11 = Pi(Factor=multiplication_11)
pi_12 = Pi(Factor=multiplication_12)
panel_11 = Panel(pi_11)
panel_12 = Panel(pi_12)
dom_6 = ConstructDomain(DomainStart=panel_11, DomainEnd=panel_12)

# ---- group: pattern 7
multiplication_13 = Multiplication(A=Slider(0, range=0..10), B=".25")
multiplication_14 = Multiplication(A=Slider(8, range=0..10), B=".25")
pi_13 = Pi(Factor=multiplication_13)
pi_14 = Pi(Factor=multiplication_14)
panel_13 = Panel(pi_13)
panel_14 = Panel(pi_14)
dom_7 = ConstructDomain(DomainStart=panel_13, DomainEnd=panel_14)

# ----
G = ClusterInput()
filter = StreamFilter(Gate=G, Stream1=dom_4, Stream2=dom_5, Stream3=dom_6, Stream4=dom, Stream5=dom_3, Stream6=dom_2, Stream7=dom_7)
s_7 = ClusterOutput(filter)

# ==== cluster QuickGraphs

# ---- group: whole shell
max_stress_comp = Number(-0.146)
max_stress_tens = Number(0.186)
max_disp = Number(0.03259199848)

# ----
max_stress_comp_2 = Number([-0.736, -0.51, -0.109, -0.151, -0.157, -0.148, -0.147, -0.147, -0.147, -0.147, -0.147])
max_stress_tens_2 = Number([4.69, 3.24, 0.333, 0.164, 0.224, 0.191, 0.184, 0.183, 0.183, 0.183, 0.183])
max_disp_2 = Number([1.58279036, 1.182691614, 0.3778172142, 0.1103610701, 0.05740937502, 0.03608507293, 0.032556884, 0.03216712047, 0.03212689201, 0.03212284776, 0.03212244312])
mag_ct = Integer([0, 1, 2, 3, 4, 5, 6, 7, 8, 9, 10])
merge = Merge(Data1=graft(max_stress_comp_2), Data2=graft(max_stress_tens_2), Data3=graft(max_disp_2))  # -> simplify(Result)
panel = Panel("""max stress comp
max stress tens
max disp""")
merge_2 = Merge(Data1=graft(max_stress_comp), Data2=graft(max_stress_tens), Data3=graft(max_disp))  # -> simplify(Result)
panel_2 = Panel(merge_2)
flip = FlipMatrix(Data=merge)
panel_3 = Panel(flip)
chart = CreateChart(
    ChartName="My Chart",
    ChartSeries=panel,
    ChartXAxisLabels=mag_ct,
    ValueTree=flip,
    Chart_Theme="Bright Pastel",
    Chart_Type="Line")

# ==== cluster DivInt
crv = ClusterInput()
num = ClusterInput()

# ---- group: divide curve integer
crv_2 = Curve(crv)
len = Length(Curve=crv_2)
num_2 = Number(num)
division = Division(A=len, B=num_2)
round = Round(Number=division)  # -> Nearest, Floor, Ceiling
divide = DivideCurve(Curve=crv_2, Count=round.Ceiling, Kinks=False)  # -> simplify(Points), Tangents, Parameters

# ----
pline = PolyLine(Vertices=divide.Points, Closed=False)
explode = Explode(Curve=pline, Recursive=True)  # -> Segments, Vertices
eval = EvaluateCurve(Curve=reparameterize(explode.Segments), Parameter=".5")  # -> Point, Tangent, Angle
midpts = Point(simplify(eval.Point))
pts = Point(divide.Points)
pts_2 = ClusterOutput(pts)
midpts_2 = ClusterOutput(midpts)

# ==== cluster CurrPoint
transformed_points = ClusterInput()
int_curr_solution = ClusterInput()
transformed_points_2 = Point(transformed_points)
int_curr_solution_2 = Integer(int_curr_solution)
branch = TreeBranch(Tree=transformed_points_2, Path=int_curr_solution_2, MaintainPaths=True)
curr_point = Point(branch)
curr_point_2 = ClusterOutput(curr_point)

# ==== cluster VectorValue
int_curr_solution = ClusterInput()
original_points = ClusterInput()
curr_point = ClusterInput()
above = ClusterInput()
original_points_2 = Point(original_points)
curr_point_2 = Point(curr_point)
int_curr_solution_2 = Integer(int_curr_solution)
number_slider = Slider(0.222, range=0..1)
above_2 = Boolean(above)
branch = TreeBranch(Tree=original_points_2, Path=int_curr_solution_2, MaintainPaths=True)
pdecon = Deconstruct(Point=branch)  # -> XComponent, YComponent, ZComponent
neg = Negative(Value=number_slider)
expression = Expression(x=pdecon.ZComponent, Expression="Format(\"{0:0.00}\", x)")
filter = StreamFilter(Gate=above_2, Stream0=neg, Stream1=number_slider)
Z = UnitZ(Factor=filter)
concat = Concatenate(FragmentA="curr: ", FragmentB=expression)
move = Move(Geometry=curr_point_2, Motion=Z)  # -> Geometry, Transform
tag = TextTag(Location=move.Geometry, Text=concat)

# ==== cluster ClosestSolution
params_current_solution = ClusterInput()
ds_coords = ClusterInput()
params_current_solution_2 = Number(params_current_solution)
ds_coords_2 = Data(simplify(ds_coords))
flip = FlipMatrix(Data=ds_coords_2)
cset = CreateSet(List=flip)  # -> Set, Map
fsim = FindSimilarMember(Data=params_current_solution_2, Set=cset.Set)  # -> Hit, Index
equals = Equality(FirstNumber=flatten(fsim.Hit), SecondNumber=ds_coords_2)  # -> Equality, Inequality
panel = Panel(equals.Equality)
mass_and = MassAND(bool=equals.Equality)
dispatch = Dispatch(List=ds_coords_2, DispatchPattern=mass_and)  # -> ListA, ListB
clean = CleanTree(RemoveNulls=True, RemoveInvalid=True, RemoveEmpty=Toggle(True), Tree=dispatch.ListA)
item = ListItem(List=clean, Index=0, Wrap=True)  # -> Item, Item1, Item2, Item3
tstat = TreeStatistics(Tree=clean)  # -> Paths, Length, Count
pt = ConstructPoint(XCoordinate=item.Item1, YCoordinate=item.Item2, ZCoordinate=item.Item3)
dpath = DeconstructPath(Branch=tstat.Paths)
sph = Sphere(Base=pt, Radius=Slider(0.018, range=0..0.1))
index_curr_vector = Integer(dpath)
design_vector = Data(clean)
index_curr_vector_2 = ClusterOutput(index_curr_vector)
design_vector_2 = ClusterOutput(design_vector)

# ==== cluster _2DGraph
original_points = ClusterInput()
ref_value = ClusterInput()
original_points_2 = Point(original_points)
ref_value_2 = Number(ref_value)
bbox = BoundingBox(Content=flatten(original_points_2), Plane=PlaneXY(0, 0, 0), UnionBox=True)  # -> Box, Box_2
pdecon = Deconstruct(Point=flatten(original_points_2))  # -> XComponent, YComponent, ZComponent
cset = CreateSet(List=pdecon.XComponent)  # -> Set, Map
cset_2 = CreateSet(List=pdecon.YComponent)  # -> Set, Map
cset_3 = CreateSet(List=pdecon.ZComponent)  # -> Set, Map
bnd = Bounds(Numbers=cset_3.Set)
domain = Domain(bnd)
target_grid_line = ClusterInput()
graph_origin = ClusterInput()
target_grid_line_2 = Integer(target_grid_line)
graph_origin_2 = Point(graph_origin)
grid_spacing = GridSpacing(domain=domain, target_grid_line=target_grid_line_2)
scale = Slider(5, range=0..10)
yz = YZPlane(Origin=graph_origin_2)
pflip = FlipPlane(Plane=yz, ReverseX=Toggle(True), ReverseY=False, SwapAxes=True)
neg = Negative(Value=scale)
planesrf = PlaneSurface(Plane=pflip, XSize=scale, YSize=neg)
planesrf_2 = PlaneSurface(Plane=yz, XSize=scale, YSize=scale)
dedomain = DeconstructDomain(Domain=domain)  # -> Start, End
merge = Merge(Data1=planesrf_2, Data2=planesrf)
sporph = Sporph(G=original_points_2, S0=bbox.Box, P0="0,0", S1=planesrf_2, P1="0,0", R=False)
transformed_points = Point(sporph)
debox = DeconstructBox(Box=bbox.Box)  # -> Plane, X, Y, Z
entwine = Entwine(Branch00=debox.X, Branch01=debox.Z, FlattenInputs=True)  # -> simplify(Result)
panel = Panel(entwine)
transformed_points_2 = ClusterOutput(transformed_points)
labels = ClusterInput()
dom = ConstructDomain(DomainStart=0, DomainEnd=1)
fixed = ClusterInput()
graph_surface = Surface(simplify(graft(merge)))
labels_2 = Text(labels)
fixed_2 = Text(fixed)
join = TextJoin(Text=flatten(fixed_2), Join="  /  ")
graph_surface_2 = Surface(merge)
transformed_points_3 = Point(transformed_points)
panel_2 = Panel(join)
md_slider = MDSlider(
    SliderMode=0,
    slider_value=Point(0.4988090701, 0, 0.5),
    x_domain=Domain(0, 1),
    y_domain=Domain(0, 1),
    z_domain=Domain(0, 1))
md_slider_2 = MDSlider(
    SliderMode=0,
    slider_value=Point(0.5026438643, 1, 0.5),
    x_domain=Domain(0, 1),
    y_domain=Domain(0, 1),
    z_domain=Domain(0, 1))
md_slider_3 = MDSlider(
    SliderMode=0,
    slider_value=Point(0.4988090701, 1, 0.5),
    x_domain=Domain(0, 1),
    y_domain=Domain(0, 1),
    z_domain=Domain(0, 1))
flip = FlipMatrix(Data=transformed_points_3)
shift = ShiftList(List=graph_surface_2, Shift=Slider(0, range=0..10), Wrap=True)  # -> simplify(graft(List))
bang = ExplodeTree(Data=shift)  # -> Branch0, Branch1
rdpoints = RemoveDuplicatePointsKaramba3D(Point=flip, LimitDistance=0.005)  # -> OutPoint, Info, Indexes
evalsrf = EvaluateSurface(Surface=reparameterize(bang.Branch1), Point=md_slider_2)  # -> Point, Normal, UDirection, VDirection, Frame
evalsrf_2 = EvaluateSurface(Surface=reparameterize(bang.Branch0), Point=md_slider)  # -> Point, Normal, UDirection, VDirection, Frame
evalsrf_3 = EvaluateSurface(Surface=reparameterize(bang.Branch0), Point=md_slider_3)  # -> Point, Normal, UDirection, VDirection, Frame
ref_value_3 = Number(ref_value_2)
deplane = DeconstructPlane(Plane=evalsrf.Frame)  # -> Origin, XAxis, YAxis, ZAxis
pt = Point(rdpoints.OutPoint)
number_slider = Slider(0.187, range=0..1)
number_slider_2 = Slider(0.331, range=0..1)
deplane_2 = DeconstructPlane(Plane=evalsrf_2.Frame)  # -> Origin, XAxis, YAxis, ZAxis
expression = Expression(x=ref_value_3, Expression="Format(\"{0:0.00}\", x)")
deplane_3 = DeconstructPlane(Plane=evalsrf_3.Frame)  # -> Origin, XAxis, YAxis, ZAxis
project = Project(Geometry=pt, Plane=PlaneXY(0, 0, 0))  # -> Geometry, Transform
amp = Amplitude(Vector=deplane.YAxis, Amplitude=Slider(0.875, range=0..1))
swatch = ColourSwatch(SwatchColor=RGB(255, 0, 0))
amp_2 = Amplitude(Vector=deplane_2.YAxis, Amplitude=Slider(0.449, range=0..1))
rev = Reverse(Vector=amp)
amp_3 = Amplitude(Vector=deplane_3.YAxis, Amplitude=Slider(0.525, range=0..1))
rev_2 = Reverse(Vector=amp_2)
rev_3 = Reverse(Vector=amp_3)
merge_2 = Merge(Data1=pt, Data2=project.Geometry)
lng = ListLength(List=project.Geometry)
Z = UnitZ(Factor=Slider(0.154, range=0..1))
move = Move(Geometry=evalsrf_2.Frame, Motion=rev_2)  # -> flatten(Geometry), Transform
swatch_2 = ColourSwatch(SwatchColor=RGB(128, 128, 128))
move_2 = Move(Geometry=evalsrf.Frame, Motion=amp)  # -> flatten(Geometry), Transform
move_3 = Move(Geometry=evalsrf_3.Frame, Motion=amp_3)  # -> flatten(Geometry), Transform
number_slider_3 = Slider(0.178, range=0..1)
frompoints = MeshFromPoints(Points=merge_2, UDirection="2", VDirection=lng)
concat = Concatenate(FragmentA="ref. value = ", FragmentB=expression)
merge_3 = Merge(Data1=move.Geometry, Data2=move_2.Geometry)
unifynormals = MeshUnifyNormals(Mesh=frompoints)
item = ListItem(List=move.Geometry, Index=0, Wrap=True)
item_2 = ListItem(List=move_3.Geometry, Index=0, Wrap=True)
tag = TextTag3D(Location=item_2, Text=join, Size=number_slider_3, Justification=5)

# ----
# if ref value is out of bounds, don't add (or just add lower bound, which is indiferent)
ref_value_4 = Number(ref_value_2)
inc = Includes(Value=ref_value_4, Domain=domain)  # -> Includes, Deviation
sort = SortList(Keys=grid_spacing)  # -> Keys, ValuesA
item_3 = ListItem(List=reverse(sort.Keys), Index=0, Wrap=True)
item_4 = ListItem(List=sort.Keys, Index=0, Wrap=True)

c_script = CSharpScript(reference=ref_value_4, domain=domain)  # -> out, A; inputs reference: Double
# ---------- c_script: C# ----------
    A = 1;
    if (reference < domain.Min) A = 0;
    if (reference > domain.Max) A = 2;
# ---------- end c_script ----------

filter = StreamFilter(Gate=c_script.A, Stream0=item_4, Stream1=ref_value_4, Stream2=item_3)

merge_4 = Merge(Data1=filter, Data2=grid_spacing)
sort_2 = SortList(Keys=merge_4)  # -> Keys, ValuesA
entwine_2 = Entwine(Branch00=cset.Set, Branch01=merge_4, FlattenInputs=True)  # -> simplify(Result)
remap = RemapNumbers(Value=entwine_2, Source=entwine, Target=dom)  # -> Mapped, Clipped
pt_2 = ConstructPoint(XCoordinate=remap.Mapped, YCoordinate=0, ZCoordinate=0)
evalsrf_4 = EvaluateSurface(Surface=reparameterize(graph_surface), Point=pt_2)  # -> Point, Normal, UDirection, VDirection, Frame
pl = ConstructPlane(Origin=evalsrf_4.Point, XAxis=evalsrf_4.VDirection, YAxis=evalsrf_4.Normal)
sec = BrepPlane(Brep=graph_surface, Plane=pl)  # -> Curves, Points
grid_lines = Curve(sec.Curves)
join_2 = JoinCurves(Curves=grid_lines, Preserve=False)
trim = TrimTree(Tree=simplify(join_2), Depth=1)
trim_2 = TrimTree(Tree=grid_lines, Depth=1)
explode = Explode(Curve=trim, Recursive=True)  # -> Segments, Vertices
item_5 = ListItem(List=trim, Index="1", Wrap=True)
lng_2 = ListLength(List=trim)
bang_2 = ExplodeTree(Data=trim_2)  # -> Branch0, Branch1
repeat = RepeatData(Data=item_5, Length=lng_2)  # -> simplify(graft(Data))
horizontal_grid_lines = Curve(bang_2.Branch1)
vertical_grid_lines = Curve(bang_2.Branch0)
bang_3 = ExplodeTree(Data=entwine_2)  # -> Branch0, Branch1
alongcrv = SortAlongCurve(Points=explode.Vertices, Curve=repeat)  # -> Points, Indices
adaptable_decimal_places = AdaptableDecimalPlaces(num=entwine_2)
pline = PolyLine(Vertices=alongcrv.Points, Closed=False)  # -> simplify(Polyline)
expression_2 = Expression(x=bang_3.Branch0, Expression="Format(\"{0:0.00e0}\", x)")
item_6 = ListItem(List=horizontal_grid_lines, Index="0", Wrap=True)
cull_i = CullIndex(List=horizontal_grid_lines, Indices="0", Wrap=True)
expression_3 = Expression(x=bang_3.Branch1, Expression="Format(\"{0:0.00e0}\", x)")
expression_4 = Expression(x=bang_3.Branch1, Expression="Format(\"{0:0.00}\", x)")
expression_5 = Expression(x=bang_3.Branch0, Expression="Format(\"{0:0}\", x)")
trim_3 = TrimTree(Tree=pline, Depth=1)
ref_grid_line = Curve(item_6)
merge_5 = Merge(Data1=vertical_grid_lines, Data2=cull_i)
bang_4 = ExplodeTree(Data=trim_3)  # -> Branch0, Branch1
midpt = CurveMiddle(Curve=ref_grid_line)
entwine_3 = Entwine(Branch00=expression_2, Branch01=expression_3, FlattenInputs=True)  # -> simplify(Result)
ext = ExtendCurve(Curve=bang_4.Branch0, Type=0, Start=number_slider, End=number_slider)
ext_2 = ExtendCurve(Curve=bang_4.Branch1, Type=0, Start=number_slider_2, End=number_slider_2)
dash = DashPattern(Curve=simplify(ref_grid_line), Pattern=Slider(0.1, range=0..1))  # -> Dashes, Gaps
panel_3 = Panel(expression_2)
move_4 = Move(Geometry=midpt, Motion=Z)  # -> Geometry, Transform
end = EndPoints(Curve=ext_2)  # -> Start, End
end_2 = EndPoints(Curve=ext)  # -> Start, End
merge_6 = Merge(Data1=end_2.End, Data2=end.Start)
labels_3 = Text(entwine_3)
preview = CustomPreview(Geometry=dash.Dashes, Material=swatch)
preview_2 = CustomPreview(Geometry=merge_5, Material=swatch_2)

mesh = Mesh(unifynormals)
tag_2 = TextTag(Location=move_4.Geometry, Text=concat, Colour=swatch)
tag_3 = TextTag3D(Location=merge_3, Text=labels_2, Size=number_slider_3, Justification=5)
tag_4 = TextTag(Location=merge_6, Text=labels_3, Colour=swatch_2)

mesh_2 = ClusterOutput(mesh)

# ==== cluster TransformPointsToLandscape
dimensons_for_variation = ClusterInput()
sectioned_data = ClusterInput()
result_label = ClusterInput()
results = ClusterInput()
result_int = ClusterInput()
dimensons_for_variation_2 = Integer(dimensons_for_variation)
sectioned_data_2 = Data(sectioned_data)
panel = Panel(sectioned_data_2)
dim_labels = ClusterInput()
result_label_2 = Text(result_label)
results_2 = Number(results)
result_int_2 = Integer(result_int)
tstat = TreeStatistics(Tree=sectioned_data_2)  # -> Paths, Length, Count
item = ListItem(List=sectioned_data_2, Index=dimensons_for_variation_2, Wrap=True)
lng = ListLength(List=dimensons_for_variation_2)
dim_labels_2 = Text(dim_labels)
gate = StreamGate(Stream=item, Gate=lng)  # -> Target0, Target1, Target2
item_2 = ListItem(List=dim_labels_2, Index=dimensons_for_variation_2, Wrap=True)
num2pt = NumbersToPoints(Numbers=gate.Target1, Mask=1)
num2pt_2 = NumbersToPoints(Numbers=gate.Target2, Mask=2)
branch = TreeBranch(Tree=results_2, Path=tstat.Paths, MaintainPaths=True)
merge = Merge(Data1=num2pt, Data2=num2pt_2)  # -> simplify(Result)
merge_2 = Merge(Data1=item_2, Data2=result_label_2)
panel_2 = Panel(merge_2)
pdecon = Deconstruct(Point=merge)  # -> XComponent, YComponent, ZComponent
item_3 = ListItem(List=branch, Index=result_int_2, Wrap=True)
pt = ConstructPoint(XCoordinate=pdecon.XComponent, YCoordinate=pdecon.YComponent, ZCoordinate=item_3)
transformed_points = Point(pt)
labels = Text(merge_2)
labels_2 = ClusterOutput(labels)
transformed_points_2 = ClusterOutput(transformed_points)

# ---- group: find fixed variable
panel_3 = Panel("""0
1
2""")
fsim = FindSimilarMember(Data=dimensons_for_variation_2, Set=panel_3)  # -> Hit, Index
cull_i = CullIndex(List=panel_3, Indices=fsim.Index, Wrap=True)
item_4 = ListItem(List=sectioned_data_2, Index=cull_i, Wrap=True)
item_5 = ListItem(List=dim_labels_2, Index=cull_i, Wrap=True)

# ----
branch_2 = TreeBranch(Tree=simplify(item_4), Path="0", MaintainPaths=True)

# ---- group: find fixed variable (continued)
item_6 = ListItem(List=branch_2, Index=0, Wrap=True)
expression = Expression(x=branch_2, Expression="Format(\"{0:0}\", x)")
concat = Concatenate(FragmentA=item_5, FragmentB=" = ", FragmentC=expression)
panel_4 = Panel(concat)

# ----
fixed = Text(concat)
fixed_2 = ClusterOutput(fixed)

# ==== cluster SectionDS
dims = ClusterInput()
design_space = ClusterInput()
design_vector = ClusterInput()
design_space_2 = Data(simplify(design_space))
dims_2 = Integer(dims)
design_vector_2 = Data(graft(design_vector))
item = ListItem(List=design_space_2, Index=0, Wrap=True)  # -> Item, Item1, Item2, Item3
flip = FlipMatrix(Data=design_space_2)
pt = ConstructPoint(XCoordinate=item.Item1, YCoordinate=item.Item2, ZCoordinate=item.Item3)
cset = CreateSet(List=flip)  # -> Set, Map
fsim = FindSimilarMember(Data=design_vector_2, Set=cset.Set)  # -> Hit, Index
trim = TrimTree(Tree=fsim.Hit, Depth=1)
equals = Equality(FirstNumber=trim, SecondNumber=design_space_2)  # -> Equality, Inequality
bool = Boolean(equals.Equality)
cull_i = CullIndex(List=bool, Indices=simplify(dims_2), Wrap=True)  # -> simplify(List)

# ---- group: check for what?
null = NullItem(Item=dims_2)  # -> NullFlags, InvalidFlags, Description
item_2 = ListItem(List=null.NullFlags, Index=0, Wrap=True)
filter = StreamFilter(Gate=item_2, Stream0=cull_i, Stream1=bool)

# ----
mass_or = MassOR(A=filter)
dispatch = Dispatch(List=design_space_2, DispatchPattern=mass_or)  # -> ListA, ListB
clean = CleanTree(RemoveNulls=True, RemoveInvalid=True, RemoveEmpty=Toggle(True), Tree=dispatch.ListA)
item_3 = ListItem(List=clean, Index=0, Wrap=True)  # -> Item, Item1, Item2, Item3
pt_2 = ConstructPoint(XCoordinate=item_3.Item1, YCoordinate=item_3.Item2, ZCoordinate=item_3.Item3)
T = ClusterOutput(clean)

# ==== cluster MinPoint
transformed_points = ClusterInput()
transformed_points_2 = Point(transformed_points)
pt = Point(transformed_points_2)
pdecon = Deconstruct(Point=pt)  # -> XComponent, YComponent, flatten(ZComponent)
tstat = TreeStatistics(Tree=pt)  # -> Paths, Length, Count
sort = SortList(Keys=pdecon.ZComponent, ValuesA=tstat.Paths)  # -> Keys, ValuesA
item = ListItem(List=sort.ValuesA, Index=0, Wrap=True)
path = DataPath(item)
branch = TreeBranch(Tree=pt, Path=path, MaintainPaths=True)
dpath = DeconstructPath(Branch=path)
min_point = Point(branch)
min_id = Integer(dpath)
min_id_2 = ClusterOutput(min_id)
min_point_2 = ClusterOutput(min_point)

# ==== cluster MinValue
int_curr_solution = ClusterInput()
original_points = ClusterInput()
curr_point = ClusterInput()
original_points_2 = Point(original_points)
curr_point_2 = Point(curr_point)
int_curr_solution_2 = Integer(int_curr_solution)
branch = TreeBranch(Tree=original_points_2, Path=int_curr_solution_2, MaintainPaths=True)
pdecon = Deconstruct(Point=branch)  # -> XComponent, YComponent, ZComponent
expression = Expression(x=pdecon.ZComponent, Expression="Format(\"{0:0.000000}\", x)")
Z = UnitZ(Factor=Slider(0.222, range=0..1))
concat = Concatenate(FragmentA="min: ", FragmentB=expression)
move = Move(Geometry=curr_point_2, Motion=Z)  # -> Geometry, Transform
tag = TextTag(Location=move.Geometry, Text=concat)

# ==== cluster CurrThumbnail
int_curr_solution = ClusterInput()
int_curr_solution_2 = Integer(int_curr_solution)
folder_file = ClusterInput()
expression = Expression(i=int_curr_solution_2, mid=Slider(90, range=0..100), Expression="If (i<mid,i,i+1)")
resolution = ClusterInput()
curr_point = ClusterInput()
folder_file_2 = Text(folder_file)
curr_point_2 = Point(curr_point)
pt = Point(curr_point_2)
yz = YZPlane(Origin=pt)
expression_2 = Expression(x=expression, Expression="Format(\"{0:000}\", x)")
xy = XYPlane(Origin=pt)
md_slider = MDSlider(SliderMode=0, slider_value=Point(0.5, 0, 0.5), x_domain=Domain(0, 1), y_domain=Domain(0, 1), z_domain=Domain(0, 1))
rotate = Rotate(Geometry=xy, Angle=1.570796327, Plane=pt)  # -> Geometry, Transform
panel = Panel("1 to 2")
resolution_2 = Integer(resolution)
rectangle = Rectangle(Plane=rotate.Geometry, XSize="-.5 to .5", YSize="-.5 to .5", Radius=0)  # -> Rectangle, Length
concat = Concatenate(FragmentA=folder_file_2, FragmentB=expression_2, FragmentC=".bmp")
evalsrf = EvaluateSurface(Surface=reparameterize(rectangle.Rectangle), Point=md_slider)  # -> Point, Normal, UDirection, VDirection, Frame
panel_2 = Panel(concat)
panel_3 = Panel(rectangle.Rectangle)

img = ImportImage(File=concat, Rectangle=rectangle.Rectangle, XSamples=resolution_2, YSamples=resolution_2)
crv = Curve(rectangle.Rectangle)

# ==== cluster BoxDims
box = ClusterInput()
box_2 = Box(box)
debox = DeconstructBox(Box=box_2)  # -> Plane, X, Y, Z
dedomain = DeconstructDomain(Domain=debox.X)  # -> Start, End
dedomain_2 = DeconstructDomain(Domain=debox.Y)  # -> Start, End
dedomain_3 = DeconstructDomain(Domain=debox.Z)  # -> Start, End
subtraction = Subtraction(A=dedomain.End, B=dedomain.Start)
subtraction_2 = Subtraction(A=dedomain_2.End, B=dedomain_2.Start)
subtraction_3 = Subtraction(A=dedomain_3.End, B=dedomain_3.Start)
dx = Number(subtraction)
dy = Number(subtraction_2)
dz = Number(subtraction_3)
dx_2 = ClusterOutput(dx)
dy_2 = ClusterOutput(dy)
dz_2 = ClusterOutput(dz)

# ==== cluster MassAND
bool = ClusterInput()
bool_2 = Boolean(bool)
lng = ListLength(List=bool_2)
ma = MassAddition(Input=bool_2)  # -> Result, PartialResults
larger = LargerThan(FirstNumber=ma.Result, SecondNumber=lng)  # -> LargerThan, OrEqualTo
bool_3 = Boolean(larger.OrEqualTo)
bool_4 = ClusterOutput(bool_3)

# ==== cluster AdaptableDecimalPlaces
num = ClusterInput()
num_2 = Number(num)
reldif = RelativeDifferences(Values=num_2)
item = ListItem(List=reverse(reldif), Index=0, Wrap=True)
split = TextSplit(Text=item, Separators=".")
item_2 = ListItem(List=reverse(split), Index=0, Wrap=True)
chars = Characters(Text=item_2)  # -> Result, Unicode
lng = ListLength(List=chars.Result)  # -> simplify(Length)
panel = Panel(chars.Result)
repeat = RepeatData(Data="0", Length=lng)
join = TextJoin(Text=repeat)
concat = Concatenate(FragmentA="{0:0.", FragmentB=join, FragmentC="}")
format = Format(Format=concat, Culture=127, Data0=num_2)
txt = Text(format)
panel_2 = Panel(format)
txt_2 = ClusterOutput(txt)

# ==== cluster GridSpacing
target_grid_line = ClusterInput()
target_grid_line_2 = Integer(target_grid_line)
domain = ClusterInput()
domain_2 = Domain(domain)
dedomain = DeconstructDomain(Domain=domain_2)  # -> Start, End
subtraction = Subtraction(A=dedomain.End, B=dedomain.Start)
abs = Absolute(Value=subtraction)
domain_size = Number(abs)
logn = LogN(Number=domain_size, Base="10")
round = Round(Number=logn)  # -> Nearest, Floor, Ceiling
subtraction_2 = Subtraction(A=round.Ceiling, B=1)
division = Division(A=domain_size, B=target_grid_line_2)
_10º = PowerOf10(Value=subtraction_2)
constant_grid_spacing = Number("2.5")
panel = Panel(division)
domain_magnitude_10n = Number(_10º)
panel_2 = Panel(""".2
.25
.5
1
2
2.5
5""")
multiplication = Multiplication(A=domain_magnitude_10n, B=panel_2)
dedomain_2 = DeconstructDomain(Domain=domain_2)  # -> Start, End
spacing_candidates = Number(multiplication)
subtraction_3 = Subtraction(A=spacing_candidates, B=division)
abs_2 = Absolute(Value=subtraction_3)
panel_3 = Panel(spacing_candidates)
distances_to_target_spacing = Number(abs_2)
subtraction_4 = Subtraction(A=dedomain_2.End, B=dedomain_2.Start)
sort = SortList(Keys=distances_to_target_spacing, ValuesA=spacing_candidates)  # -> Keys, ValuesA
item = ListItem(List=sort.ValuesA, Index=0, Wrap=True)
closest_to_target_spacing = Number(item)
adaptable_grid_spacing = Number(closest_to_target_spacing)
grid_spacing = Number(simplify(graft(adaptable_grid_spacing)))
mod = Modulus(A=dedomain_2.Start, B=grid_spacing)  # -> simplify(Result)
subtraction_5 = Subtraction(A=dedomain_2.Start, B=mod)
addition = Addition(A=subtraction_5, B=grid_spacing)  # -> simplify(Result)
division_2 = Division(A=subtraction_4, B=grid_spacing)  # -> simplify(Result)
series = Series(Start=addition, Step=grid_spacing, Count=division_2)  # -> simplify(flatten(Series))
merge = Merge(Data1=dedomain_2.Start, Data2=series, Data3=dedomain_2.End)
grid_values = Number(merge)
grid_values_2 = ClusterOutput(grid_values)

# ==== cluster MassOR
A = ClusterInput()
not = GateNot(A=A)
ma = MassAddition(Input=not)  # -> Result, PartialResults
not_2 = GateNot(A=ma.Result)
R = ClusterOutput(not_2)
